# Grasshopper definition 00_assembly_design.ghx (Grasshopper 1.0.8)

# ----
# Create a part
toggle = BooleanToggle(True)
part = Python3Script()  # -> out, part
# ---------- part: Python ----------
from compas.geometry import Frame, Vector, Box
from compas.geometry import Transformation, Translation
# from assembly_information_model import Part

from qut_assembly import MarkedPart

# dimensions
width = 0.07
length = 0.30
height = 0.035

# create parte
center_frame = Frame([0., 0., 0.], [0, 1, 0], [1, 0, 0]) #center of the box frame 
part_geometry = Box(width, length, height, center_frame, 'box')

    #create pick plane for gripper
offset = Vector (0,width/2,0)
pick_plane = Frame(center_frame.point + offset, center_frame.xaxis, center_frame.yaxis)


part = MarkedPart.from_shape(part_geometry, name="Part", frame=pick_plane)
part.height = height

marker_offset_x = 0.010
marker_offset_y = -0.005
marker_offset_z = 0
Tvec = Vector(marker_offset_x, marker_offset_y, marker_offset_z)
part.marker_frame = center_frame.transformed(Translation.from_vector(Tvec))
# ---------- end part ----------
show = Python3Script(my_part=part.part, show=toggle)  # -> out, plane, mesh
# ---------- show: Python ----------
from compas_rhino.conversions import mesh_to_rhino, box_to_rhino, frame_to_rhino


if show:

    #extract the mesh of the part for visulization
    compas_mesh = my_part.mesh
    #convert to rhino mesh
    mesh = mesh_to_rhino(compas_mesh)
    
    #extract the frame of the part for visulization
    frame = my_part.frame
    #convert to rhino plane
    plane = frame_to_rhino(frame)
# ---------- end show ----------
pln = Plane(show.plane)
geo = Geometry(show.mesh)

# ----
# Design from curve
crv = Curve(<curve referenced from the Rhino model>)
division = Division(A=Slider(0.35, range=0..1), B="2")
Z = UnitZ(Factor=Slider(0.035, range=0..0.1))
move = Move(Geometry=crv, Motion=Z)  # -> Geometry, Transform
divlength = DivideLength(Curve=crv, Length=division)  # -> Points, Tangents, Parameters
divlength_2 = DivideLength(Curve=move.Geometry, Length=division)  # -> Points, Tangents, Parameters
dispatch = Dispatch(List=divlength_2.Parameters, DispatchPattern=[True, False])  # -> ListA, ListB
dispatch_2 = Dispatch(List=divlength.Parameters, DispatchPattern=[True, False])  # -> ListA, ListB
frame = CurveFrame(Curve=crv, Parameter=dispatch_2.ListA)
frame_2 = CurveFrame(Curve=move.Geometry, Parameter=dispatch.ListB)
orient = Orient(Geometry=geo, Source=PlaneXY(0, 0, 0), Target=frame_2)  # -> Geometry, Transform
orient_2 = Orient(Geometry=geo, Source=PlaneXY(0, 0, 0), Target=frame)  # -> Geometry, Transform

# ----
# Unload Python modules
button = Button()
unload = Python3Script(unload=button)  # -> out, a
# ---------- unload: Python ----------
from compas_rhino import unload_modules

unload_modules('assembly_information_model')
unload_modules('assembly_information_model.assembly')
unload_modules('assembly_information_model.part')
unload_modules('qut_assembly')
# ---------- end unload ----------

# ----
# Transform part
merge = Merge(Data1=frame, Data2=frame_2)

pln_2 = Plane(merge)

create_parts = Python3Script(part=part.part, planes=pln_2)  # -> out, parts; inputs planes: list of Plane
# ---------- create_parts: Python ----------
from compas.geometry import Frame, Transformation
from compas_rhino.conversions import plane_to_compas_frame

frames = [plane_to_compas_frame(plane) for plane in planes]
print(frames)
parts = []
for frame in frames:
    T = Transformation.from_frame_to_frame(Frame.worldXY(), frame)
    parts.append(part.transformed(T))
# ---------- end create_parts ----------

# ----
# Create the assembly
toggle_2 = BooleanToggle(True)
assembly = Python3Script(create=toggle_2, parts=create_parts.parts)  # -> out, assembly; inputs parts: list
# ---------- assembly: Python ----------
import math

from compas.geometry import Frame, Point
from compas.geometry import Transformation, Rotation, Translation
from compas_rhino.conversions import plane_to_compas_frame

from assembly_information_model.assembly import Assembly

if create:
    #create empty assembly
    assembly = Assembly()

    for part in parts:
        assembly.add_part(part)
# ---------- end assembly ----------

cp = Plane(PlaneXY(0.4, 0.4, 0))
cp_new = Plane(PlaneXY(0.8, 0.4, 0))
transform = Python3Script(assembly=assembly.assembly, transform=Toggle(False), center_plane=cp, center_plane_new=cp_new)  # -> out, assembly
# ---------- transform: Python ----------
from compas.geometry import Frame, Transformation, Rotation, Translation
from compas_rhino.conversions import plane_to_compas_frame

center_frame = plane_to_compas_frame(center_plane)
center_frame_new = plane_to_compas_frame(center_plane_new)


if transform:
    T = Transformation.from_frame_to_frame(center_frame, center_frame_new)
    assembly = assembly.transformed(T)
# ---------- end transform ----------

reset = Button()
back = Button()
start = Button()
stop = Button()
step = Button()
full = Button()
list = ValueList({"20", "50", "100", "500", "1000", "5000"}, selected="500")
counter = Python3Script(assembly=transform.assembly, start=start, stop=stop, step=step, step_back=back, reset=reset, full=full, interval=list)  # -> out, counter
# ---------- counter: Python ----------
from scriptcontext import sticky as st
import Grasshopper

def update_component(ghenv, delay):
    """Schedule an update of the Grasshopper component.

    After the specified delay, the GH component will be automatically updated.

    Parameters
    ----------
    ghenv : :class:`GhPython.Component.PythonEnvironment`
        The current GHPython environment.
    delay : :obj:`int`
        Time in milliseconds until the update is performed.

    Raises
    ------
    ValueError
        If the delay is less than zero.

    """
    if delay <= 0:
        raise ValueError("Delay must be greater than zero")

    ghcomp = ghenv.Component
    ghdoc = ghcomp.OnPingDocument()

    def callback(ghdoc):
        if ghdoc.SolutionState != Grasshopper.Kernel.GH_ProcessStep.Process:
            ghcomp.ExpireSolution(False)

    ghdoc.ScheduleSolution(delay, Grasshopper.Kernel.GH_Document.GH_ScheduleDelegate(callback))

L = range(assembly.graph.number_of_nodes())

# store data in component
guid = str(ghenv.Component.InstanceGuid)
counter_key = "counter_" + guid
running_key = "running_" + guid

if counter_key not in st:
    st[counter_key] = 0

if running_key not in st:
    st[running_key] = False
    

if st[running_key]:
    if st[counter_key] < len(L) - 1:
        st[counter_key] += 1
        update_component(ghenv, interval)
    else:
        st[counter_key] = 0
        st[running_key] = False
    
if start:
    st[running_key] = True

if stop:
    st[running_key] = False

if step:
    if st[counter_key] < len(L) - 1:
        st[counter_key] += 1

if step_back:
    if st[counter_key] < len(L) - 1:
        st[counter_key] -= 1

if reset:
    st[counter_key] = 0
    st[running_key] = False

if full:
    st[counter_key] = len(L)-1

if len(L):
    item = L[st[counter_key]]


#st["visualisation_counter"] = st[counter_key]
counter = st[counter_key]+1
# ---------- end counter ----------
panel = Panel(counter.counter)

# ----
# Draw
list_2 = ValueList({"show all": "show_all", "show until key": "show_until_key"}, selected="show all")
visualize = Python3Script(assembly=transform.assembly, show=list_2, highlight_current_part=Toggle(True), counter=counter.counter)  # -> out, parts_geometry, parts_frame, current_part_geometry, current_part_frame
# ---------- visualize: Python ----------
from compas_rhino.conversions import mesh_to_rhino, box_to_rhino, frame_to_rhino

#print assembly
print(assembly)

#get parts datastructure
parts = [p for p in assembly.parts()]

#get current part



if show == "show_all":
    
    #extract the mesh of the parts for visulization (+ converted to rhino mesh)
    parts_geometry = [mesh_to_rhino(p.mesh) for p in parts]
    
    #extract the frame of the parts for visulization (+ converted to rhino plane)
    parts_frame = [frame_to_rhino(p.frame) for p in parts]

    key = assembly.graph.number_of_nodes()-1

if show == "show_until_key":
    #extract the mesh of the parts for visulization (+ converted to rhino mesh)
    parts_geometry = [mesh_to_rhino(p.mesh) for p in parts[0:counter]]
    
    #extract the frame of the parts for visulization (+ converted to rhino plane)
    parts_frame = [frame_to_rhino(p.frame) for p in parts[0:counter]]

    key = counter-1

if highlight_current_part:
    current_part = assembly.part(key)
    current_part_geometry = mesh_to_rhino(current_part.attributes["mesh"])
    current_part_frame = frame_to_rhino(current_part.frame)
# ---------- end visualize ----------
panel_2 = Panel(visualize.out)
geo_2 = Geometry([visualize.current_part_geometry, visualize.current_part_frame])
geo_3 = Geometry(visualize.parts_frame)
geo_4 = Geometry(visualize.parts_geometry)
preview = CustomPreview(Geometry=geo_3, Material=ColourSwatch(SwatchColor=RGB(255, 125, 157)))
preview_2 = CustomPreview(Geometry=geo_4, Material=ColourSwatch(SwatchColor=RGBA(255, 227, 227, 233)))
preview_3 = CustomPreview(Geometry=geo_2, Material=ColourSwatch(SwatchColor=RGB(255, 125, 157)))
