# Grasshopper definition 02_robot_base_map_evaluation.ghx (Grasshopper 1.0.8)

# ----
# Design from curve
number_slider = Slider(0.35, range=0..1)
crv = Curve(<curve referenced from the Rhino model>)
division = Division(A=number_slider, B="2")
divlength = DivideLength(Curve=crv, Length=division)  # -> Points, Tangents, Parameters

# ----
# Create a part
toggle = BooleanToggle(True)
part = Python3Script()  # -> out, part
# ---------- part: Python ----------
from compas.geometry import Frame, Vector, Box
from compas.geometry import Transformation, Translation
# from assembly_information_model import Part

from qut_assembly import MarkedPart

# dimensions
width = 0.07
length = 0.30
height = 0.035

# create parte
center_frame = Frame([0., 0., 0.], [0, -1, 0], [1, 0, 0]) #center of the box frame 
part_geometry = Box(width, length, height, center_frame, 'box')

    #create pick plane for gripper
offset = Vector (0,width/2,0)
pick_plane = Frame(center_frame.point + offset, center_frame.xaxis, center_frame.yaxis)


part = MarkedPart.from_shape(part_geometry, name="Part", frame=pick_plane)
part.height = height

marker_offset_x = 0.010
marker_offset_y = -0.005
marker_offset_z = 0
Tvec = Vector(marker_offset_x, marker_offset_y, marker_offset_z)
part.marker_frame = center_frame.transformed(Translation.from_vector(Tvec))
# ---------- end part ----------
show = Python3Script(my_part=part.part, show=toggle)  # -> out, plane, mesh
# ---------- show: Python ----------
from compas_rhino.conversions import mesh_to_rhino, box_to_rhino, frame_to_rhino


if show:

    #extract the mesh of the part for visulization
    compas_mesh = my_part.mesh
    #convert to rhino mesh
    mesh = mesh_to_rhino(compas_mesh)
    
    #extract the frame of the part for visulization
    frame = my_part.frame
    #convert to rhino plane
    plane = frame_to_rhino(frame)
# ---------- end show ----------
pln = Plane(show.plane)
geo = Geometry(show.mesh)

# ----
# Unload Python modules
button = Button()
unload = Python3Script(unload=button)  # -> out, a
# ---------- unload: Python ----------
from compas_rhino import unload_modules

unload_modules('assembly_information_model')
unload_modules('assembly_information_model.assembly')
unload_modules('assembly_information_model.part')
unload_modules('qut_assembly')
# ---------- end unload ----------

Z = UnitZ(Factor=1)
xprod = CrossProduct(VectorA=divlength.Tangents, VectorB=Z, Unitize=False)  # -> Vector, Length
pl = ConstructPlane(Origin=divlength.Points, XAxis=divlength.Tangents, YAxis=xprod.Vector)
pln_2 = Plane(pl)

# ----
# Transform part
merge = Merge()
create_parts = Python3Script(part=part.part, planes=pln_2)  # -> out, parts; inputs planes: list of Plane
# ---------- create_parts: Python ----------
from compas.geometry import Frame, Transformation
from compas_rhino.conversions import plane_to_compas_frame

frames = [plane_to_compas_frame(plane) for plane in planes]
print(frames)
parts = []
for frame in frames:
    T = Transformation.from_frame_to_frame(Frame.worldXY(), frame)
    parts.append(part.transformed(T))
# ---------- end create_parts ----------

# ----
# Base pose search
rec = Rectangle({Plane=PlaneXY(2.441377483, 2.322391874, 0), Size=Domain2(u=-2.072133871..2.072133871, v=-0.7090924911..0.7090924911)})
dam = DataDam(DataSelected_planes=merge, BufferDelay=10000000, BufferMode=0)

# ----
# Reachabilitymap from JSON
list = ValueList({"ur10e_map.json", "rbvogui_xl_ur10e_and_liftkit": "rbvogui_xl_ur10e_and_liftkit.json", "rbvogui_xl_ur10e_and_liftkit_0_4": "rbvogui_xl_ur10e_and_liftkit_0_4.json", "rbvogui_xl_ur10e_and_liftkit_earthex_0_4": "rbvogui_xl_ur10e_and_liftkit_earthex_0_4.json", "rbvogui_xl_ur10e_and_liftkit_earthex_0_4_compas2.json"}, selected="rbvogui_xl_ur10e_and_liftkit_earthex_0_4_compas2.json")
py3 = Python3Script()  # -> DATA
# ---------- py3: Python ----------
import os

package_path = ghdoc.Path
# .stl files not stored in am_hackathon repo. but in mobile_fabrication_control
DATA = os.path.abspath(os.path.join(package_path,"../../data/reachabilitymaps"))

print(package_path)
print(DATA)
# ---------- end py3 ----------
py3_2 = Python3Script(DATA=py3, file=list)  # -> out, filepath
# ---------- py3_2: Python ----------
__author__ = "Gido"
__version__ = "2023.04.18"

import os
import rhinoscriptsyntax as rs

filepath = os.path.join(DATA, file)
assert filepath
# ---------- end py3_2 ----------
load_map = Python3Script(filepath=py3_2.filepath, load=Toggle(True))  # -> out, reachabilitymap
# ---------- load_map: Python ----------
__author__ = "Gido"
__version__ = "2023.04.18"

import rhinoscriptsyntax as rs
from compas.geometry import Point, Frame
from base_positioning import ReuleauxReachability, WsSphere
import json

if load:
    reachabilitymap = ReuleauxReachability.from_json(filepath)
# ---------- end load_map ----------
visualize_map = Python3Script(reachabilitymap=load_map.reachabilitymap)  # -> out, reachabilitymap, sphere_points, resolution, reachability_index
# ---------- visualize_map: Python ----------
__author__ = "Gido"
__version__ = "2023.04.17"

import rhinoscriptsyntax as rs

from compas.geometry import Frame
from compas_ghpython.drawing import draw_frame


sphere_points = []
reachability_index = []
for point, ri in reachabilitymap.spheres_data(yield_ri=True):
    sphere_points.append(draw_frame(Frame(point, [1,0,0], [0,1,0])))
    reachability_index.append(ri)
#sphere_points = draw_frames(sphere_frames)
if reachabilitymap.resolution != 0:
    resolution = reachabilitymap.resolution
else:
    resolution = 0.1
# ---------- end visualize_map ----------
gradient = Gradient(
    LowerLimit=0,
    UpperLimit=100,
    Parameter=visualize_map.reachability_index,
    stops=[0: RGB(234, 38, 0), 0.25: RGB(234, 126, 0), 0.5: RGB(254, 244, 84), 0.75: RGB(173, 203, 249), 1: RGB(75, 107, 169)])
dots = DotDisplay(Point=visualize_map.sphere_points, Colour=gradient, Size=Slider(0.07, range=0..0.15))

# ---- group: Create base pose grid
# Base poses
number_slider_2 = Slider(0.1, range=0..1)
py3_3 = Python3Script(rectangle=rec, resolution=number_slider_2)  # -> out, rpoints; inputs rectangle: Rectangle3d, resolution: Double
# ---------- py3_3: Python ----------
__author__ = "Gido"
__version__ = "2024.01.10"

import rhinoscriptsyntax as rs
from compas.geometry import Point, Pointcloud
from compas.geometry import Frame, Transformation, Translation
from compas.geometry import transform_points
from base_positioning import BaseMap

print(rectangle)

bm = BaseMap()
pc = bm.populate_rectangle(rectangle, resolution)

print(rectangle.Height)
print(rectangle.Width)
print(rectangle.Plane)

points_data = [{"pos":[pt.x, pt.y, pt.z]} for pt in pc.points]

from compas_ghpython.drawing import draw_points

rpoints = draw_points(points_data)
# ---------- end py3_3 ----------

# ----
vec2pt = Vector2Pt(PointA=graft(py3_3.rpoints), PointB=dam, Unitize=False)  # -> Vector, Length
ma = MassAddition(Input=vec2pt.Vector)  # -> Result, PartialResults
unit = UnitVector(Vector=ma.Result)  # -> flatten(Vector)
Z_2 = UnitZ(Factor="-1")
xprod_2 = CrossProduct(VectorA=unit, VectorB=Z_2, Unitize=False)  # -> Vector, Length
pl_2 = ConstructPlane(Origin=py3_3.rpoints, XAxis=unit, YAxis=xprod_2.Vector)

# ----
# Create the assembly
toggle_2 = BooleanToggle(True)
assembly = Python3Script(create=toggle_2, parts=create_parts.parts)  # -> out, assembly; inputs parts: list
# ---------- assembly: Python ----------
import math

from compas.geometry import Frame, Point
from compas.geometry import Transformation, Rotation, Translation
from compas_rhino.conversions import plane_to_compas_frame

from assembly_information_model.assembly import Assembly

if create:
    #create empty assembly
    assembly = Assembly()

    for part in parts:
        assembly.add_part(part)
# ---------- end assembly ----------

cp = Plane(PlaneXY(0.4, 0.4, 0))
cp_new = Plane(PlaneXY(0.8, 0.4, 0))
transform = Python3Script(assembly=assembly.assembly, transform=Toggle(False), center_plane=cp, center_plane_new=cp_new)  # -> out, assembly
# ---------- transform: Python ----------
from compas.geometry import Frame, Transformation, Rotation, Translation
from compas_rhino.conversions import plane_to_compas_frame

center_frame = plane_to_compas_frame(center_plane)
center_frame_new = plane_to_compas_frame(center_plane_new)


if transform:
    T = Transformation.from_frame_to_frame(center_frame, center_frame_new)
    assembly = assembly.transformed(T)
# ---------- end transform ----------

Z_3 = UnitZ(Factor=Slider(0.035, range=0..0.1))
sift = SiftPattern(List=pl, SiftPattern=[0, 1])  # -> Output0, Output1
move = Move(Geometry=sift.Output1, Motion=Z_3)  # -> Geometry, Transform
entwine = Entwine(Branch00=sift.Output0, Branch01=move.Geometry, FlattenInputs=True)

# ----
# Base Map Reuleaux Calculation
resolution = Slider(0.4, range=0..1)
py3_4 = Python3Script(goal_points=dam, base_poses=pl_2, reuleaux_map=load_map.reachabilitymap, map_resolution=resolution, compute=Toggle(True))  # -> out, base_map; inputs goal_points: list of Point3d, base_poses: list of Plane
# ---------- py3_4: Python ----------
__author__ = "Gido"
__version__ = "2023.09.12"

import rhinoscriptsyntax as rs
from compas.geometry import Frame, Pointcloud
from base_positioning import BaseMap
from compas_ghpython.drawing import draw_points

if compute:
    base_map = BaseMap()
    goal_pointcloud = Pointcloud(goal_points)
    # start_pointcloud = Pointcloud(start_points)
    if reuleaux_map.resolution == 0:
        reuleaux_map.resolution = map_resolution
    for base_pose in base_poses:
        base_frame = Frame(base_pose.Origin, base_pose.XAxis, base_pose.YAxis)
        
        base_map.get_reuleaux_index_by_base_pose(base_frame, reuleaux_map, goal_pointcloud)
# ---------- end py3_4 ----------
pt = Point(dam)
py3_5 = Python3Script(base_map=py3_4.base_map, points=pt, part_distance=Slider(0.7, range=0..1))  # -> out, base_map; inputs points: list of Point3d
# ---------- py3_5: Python ----------
from compas.geometry import Pointcloud

pc = Pointcloud(points)

key, data = base_map.get_ideal_pose_with_closeness_penalty(pc, distance=part_distance)
# ---------- end py3_5 ----------

reset = Button()
back = Button()
start = Button()
stop = Button()
step = Button()
full = Button()
list_2 = ValueList({"20", "50", "100", "500", "1000", "5000"}, selected="500")
counter = Python3Script(assembly=transform.assembly, start=start, stop=stop, step=step, step_back=back, reset=reset, full=full, interval=list_2)  # -> out, counter
# ---------- counter: Python ----------
from scriptcontext import sticky as st
import Grasshopper

def update_component(ghenv, delay):
    """Schedule an update of the Grasshopper component.

    After the specified delay, the GH component will be automatically updated.

    Parameters
    ----------
    ghenv : :class:`GhPython.Component.PythonEnvironment`
        The current GHPython environment.
    delay : :obj:`int`
        Time in milliseconds until the update is performed.

    Raises
    ------
    ValueError
        If the delay is less than zero.

    """
    if delay <= 0:
        raise ValueError("Delay must be greater than zero")

    ghcomp = ghenv.Component
    ghdoc = ghcomp.OnPingDocument()

    def callback(ghdoc):
        if ghdoc.SolutionState != Grasshopper.Kernel.GH_ProcessStep.Process:
            ghcomp.ExpireSolution(False)

    ghdoc.ScheduleSolution(delay, Grasshopper.Kernel.GH_Document.GH_ScheduleDelegate(callback))

L = range(assembly.graph.number_of_nodes())

# store data in component
guid = str(ghenv.Component.InstanceGuid)
counter_key = "counter_" + guid
running_key = "running_" + guid

if counter_key not in st:
    st[counter_key] = 0

if running_key not in st:
    st[running_key] = False
    

if st[running_key]:
    if st[counter_key] < len(L) - 1:
        st[counter_key] += 1
        update_component(ghenv, interval)
    else:
        st[counter_key] = 0
        st[running_key] = False
    
if start:
    st[running_key] = True

if stop:
    st[running_key] = False

if step:
    if st[counter_key] < len(L) - 1:
        st[counter_key] += 1

if step_back:
    if st[counter_key] < len(L) - 1:
        st[counter_key] -= 1

if reset:
    st[counter_key] = 0
    st[running_key] = False

if full:
    st[counter_key] = len(L)-1

if len(L):
    item = L[st[counter_key]]


#st["visualisation_counter"] = st[counter_key]
counter = st[counter_key]+1
# ---------- end counter ----------
panel = Panel(counter.counter)

# ----
# Draw
list_3 = ValueList({"show all": "show_all", "show until key": "show_until_key"}, selected="show until key")
visualize = Python3Script(assembly=transform.assembly, show=list_3, highlight_current_part=Toggle(True), counter=counter.counter)  # -> out, parts_geometry, parts_frame, current_part_geometry, current_part_frame
# ---------- visualize: Python ----------
from compas_rhino.conversions import mesh_to_rhino, box_to_rhino, frame_to_rhino

#print assembly
print(assembly)

#get parts datastructure
parts = [p for p in assembly.parts()]

#get current part



if show == "show_all":
    
    #extract the mesh of the parts for visulization (+ converted to rhino mesh)
    parts_geometry = [mesh_to_rhino(p.mesh) for p in parts]
    
    #extract the frame of the parts for visulization (+ converted to rhino plane)
    parts_frame = [frame_to_rhino(p.frame) for p in parts]

    key = assembly.graph.number_of_nodes()-1

if show == "show_until_key":
    #extract the mesh of the parts for visulization (+ converted to rhino mesh)
    parts_geometry = [mesh_to_rhino(p.mesh) for p in parts[0:counter]]
    
    #extract the frame of the parts for visulization (+ converted to rhino plane)
    parts_frame = [frame_to_rhino(p.frame) for p in parts[0:counter]]

    key = counter-1

if highlight_current_part:
    current_part = assembly.part(key)
    current_part_geometry = mesh_to_rhino(current_part.attributes["mesh"])
    current_part_frame = frame_to_rhino(current_part.frame)
# ---------- end visualize ----------
panel_2 = Panel(visualize.out)
geo_2 = Geometry([visualize.current_part_geometry, visualize.current_part_frame])
geo_3 = Geometry(visualize.parts_frame)
geo_4 = Geometry(visualize.parts_geometry)
preview = CustomPreview(Geometry=geo_3, Material=ColourSwatch(SwatchColor=RGB(255, 125, 157)))
preview_2 = CustomPreview(Geometry=geo_4, Material=ColourSwatch(SwatchColor=RGBA(255, 227, 227, 233)))
preview_3 = CustomPreview(Geometry=geo_2, Material=ColourSwatch(SwatchColor=RGB(255, 125, 157)))

# ----
# Update robot base location
base_plane = Plane(Plane(origin=(1.276877991, 1.759565459, 0), x=(-0.4144677566, 0.9100639971, 0), y=(-0.9100639971, -0.4144677566, 0)))
# Update tool target
base_plane_2 = Plane(visualize.current_part_frame)

# ----
# Base Map Visualization
toggle_3 = BooleanToggle(True)
py3_6 = Python3Script(base_map=py3_5.base_map, apply_segment_penalty=toggle_3, apply_collision_penalty=Toggle(False), show=Toggle(True))  # -> out, planes, reuleaux_indices
# ---------- py3_6: Python ----------
import rhinoscriptsyntax as rs
from compas_ghpython.drawing import draw_frame
from statistics import mean
import math

planes = []
reuleaux_indices = []
if show:
    for node, data in base_map.base_map.nodes(data=True):
        # print(node)
        planes.append(draw_frame(data['frame']))
        reuleaux_data = data['reuleaux_data']
        if apply_segment_penalty and apply_collision_penalty:
            sum_penalties = data["penalty_factor"] + data["collision_penalty_factor"]
            if data["penalty_factor"] + data["collision_penalty_factor"] > 1:
                sum_penalties = 1.0
            ri_mean = data["mean_reuleaux_index"] * (1- sum_penalties)
        elif apply_segment_penalty:
            ri_mean = data["mean_reuleaux_index"] * (1- data["penalty_factor"])
        elif apply_collision_penalty:
            ri_mean = data["mean_reuleaux_index"] * (1- data["collision_penalty_factor"])
        else:
            ri_mean = data['mean_reuleaux_index']
        reuleaux_indices.append(ri_mean)
# ---------- end py3_6 ----------
bnd = Bounds(Numbers=py3_6.reuleaux_indices)
dedomain = DeconstructDomain(Domain=bnd)  # -> Start, End
gradient_2 = Gradient(
    LowerLimit=dedomain.Start,
    UpperLimit=dedomain.End,
    Parameter=py3_6.reuleaux_indices,
    stops=[0.001: RGB(0, 0, 0), 0.276: RGB(254, 244, 84), 0.75: RGB(173, 203, 249), 1: RGB(75, 107, 169)])
dots_2 = DotDisplay(Point=py3_6.planes, Colour=gradient_2, Size=expr("x/10", Slider(0.4, range=0..1)))

# ----
# ROS client
list_4 = ValueList({"local": "127.0.0.1", "linux computer": "192.168.0.42", "linux eduroam": "10.181.95.254", "linux ccnet": "192.168.0.102", "linux vmware": "192.168.199.36", "robot": "192.168.0.200", "robotAA_wifi": "192.168.0.111", "robotAB_wifi": "192.168.0.112", "robotAB_eduroam": "10.181.67.95"}, selected="local")
connect = BooleanToggle(True)
ros = Python3Script(ip=list_4, port="9090", connect=connect)  # -> out, ros_client, is_connected; inputs ip: String, port: Int32, connect: Boolean
# ---------- ros: Python ----------
"""
Connect or disconnect to ROS.

COMPAS FAB v0.27.0
"""
from scriptcontext import sticky as st

from compas_fab.backends import RosClient

ros_client = None

ip = ip or '127.0.0.1'
port = port or 9090
key = "ros_client_001"
ros_client = st.get(key, None)

if ros_client:
    st[key].close()
if connect:
    st[key] = RosClient(ip, port)
    st[key].run(5)

ros_client = st.get(key, None)
is_connected = ros_client.is_connected if ros_client else False
# ---------- end ros ----------
panel_3 = Panel(ros.is_connected)

# ----
# Load robot from ROS
load = Button()
# Make sure that ros bridge, file server, tf2_web_republisher and moveit config is running on the robot!
panel_4 = Panel("")
mobile_robot = Python3Script(ros_client=ros.ros_client, prefix=panel_4, load=load)  # -> out, mobile_robot; inputs prefix: String
# ---------- mobile_robot: Python ----------
"""
Load robot directly from ROS.

COMPAS FAB v0.27.0
"""
from mobile_robot_control.mobile_robot import MobileRobot
from mobile_robot_control.mobile_robot_client import MobileRobotClient
import compas_robots.ghpython

# from ghpythonlib.componentbase import executingcomponent as component
from scriptcontext import sticky as st
import Rhino
import scriptcontext

scriptcontext.doc = Rhino.RhinoDoc.ActiveDoc

from compas_robots import RobotModel
from compas.scene import SceneObject
# from compas_robots.ghpython.scene import RobotModelObject

scriptcontext.doc = ghdoc

key = 'robot_AA'
print(key)
if ros_client and ros_client.is_connected and load:
    # Load URDF from ROS
    robot = ros_client.load_robot(
            load_geometry=True, 
            urdf_param_name= '{}/robot_description'.format(prefix),
            srdf_param_name= '{}/robot_description_semantic'.format(prefix))
    robot.scene_object = SceneObject(item=robot.model)
    mobile_robot = MobileRobot(robot.model, robot.scene_object, robot.semantics, client=None)
    st[key] = mobile_robot

mobile_robot = st.get(key, None)
if mobile_robot:  # client sometimes need to be restarted, without needing to reload geometry
    mobile_robot.mobile_client = MobileRobotClient(ros_client)
    mobile_robot.client = ros_client
# ---------- end mobile_robot ----------

reload = Button()
# ROBOT
py3_7 = Python3Script()  # -> HERE, DATA, ROBOT_DESCRIPTION
# ---------- py3_7: Python ----------
import os

HERE = os.path.dirname(ghdoc.Path)
DATA = os.path.abspath(os.path.join(HERE, "..", "data"))
ROBOT_DESCRIPTION = os.path.abspath(os.path.join(DATA, "robot_description"))

print(HERE)
print(DATA)
print(ROBOT_DESCRIPTION)
# ---------- end py3_7 ----------
reload_2 = Python3Script(reload=reload)  # -> out
# ---------- reload_2: Python ----------
if reload:
    from compas_rhino import unload_modules
    unload_modules("assembly_information_model")
    unload_modules('ur_fabrication_control')
# ---------- end reload_2 ----------

robot = Data(mobile_robot.mobile_robot)
info = Python3Script(robot=robot)  # -> out, main_group_name
# ---------- info: Python ----------
if robot:
    robot.info()
    main_group_name = robot.main_group_name
# ---------- end info ----------
panel_5 = Panel(info.out)

# ----
# Move mobile robot base
list_5 = ValueList({"origin", "set_to_BCF", "set_to_RCF"}, selected="set_to_BCF")
origin = Point(Point(1, -1, 0))
angle = Slider(0, range=0..360)
plane = Python3Script(origin=origin, angle=angle)  # -> plane; inputs origin: Point3d
# ---------- plane: Python ----------
import Rhino.Geometry as rg
import math

plane = rg.Plane(origin, rg.Vector3d.XAxis, rg.Vector3d.YAxis)
plane.Rotate(math.radians(angle), rg.Vector3d.ZAxis)
# ---------- end plane ----------
set_frame = Python3Script(robot=robot, set_frame_to=list_5, target_BCF=base_plane, target_RCF=plane)  # -> bang; inputs target_BCF: Plane, target_RCF: Plane
# ---------- set_frame: Python ----------
from compas_ghpython.drawing import draw_frame
from compas.geometry import Frame, Point, Vector, Transformation
from compas.datastructures import Mesh
from compas_fab.robots import CollisionMesh
from compas_rhino.conversions import plane_to_compas_frame

if set_frame_to == "set_to_BCF":
    BCF = plane_to_compas_frame(target_BCF)
elif set_frame_to == "set_to_RCF":
    RCF = plane_to_compas_frame(target_RCF)
    BCF = robot.transform_frame_from_RCF_to_BCF(RCF)
else:
    BCF = Frame.worldXY()

if robot:
    robot.BCF = BCF
# ---------- end set_frame ----------

# ----
# Attach tool
list_6 = ValueList({"measurement tool": 0, "gripper": 1}, selected="gripper")
show_2 = BooleanToggle(False)
path = Python3Script()  # -> DATA
# ---------- path: Python ----------
import os

package_path = ghdoc.Path
DATA = os.path.abspath(os.path.join(package_path,"../../data"))

print(package_path)
print(DATA)
# ---------- end path ----------
tool = Python3Script(data_path=path, tool=list_6, show=show_2)  # -> tool, M, ee_plane; inputs data_path: String
# ---------- tool: Python ----------
import os, math
from compas.geometry import Frame, Rotation, Vector
from compas.datastructures import Mesh
from compas_rhino.conversions import mesh_to_rhino, frame_to_rhino_plane
from compas_fab.robots import Tool

tolerance = 0

if tool == 0:
    filename = 'measurement_tool_zaxis.stl'
    ee_frame = Frame([0, 0, 0.109], [1, 0, 0], [0, 1, 0])

elif tool == 1:
    filename = 'gripper_small.stl'
    ee_frame = Frame([-0.06185557, -0, 0.37374513], [1, 0, 0], [0, 1, 0])

data_path = os.path.join(data_path, "tool_geometry")
fullfilename = os.path.join(data_path, filename)

ee_mesh = Mesh.from_stl(fullfilename)

if show:
    M = mesh_to_rhino(ee_mesh)

tool = Tool(ee_mesh, ee_frame)
ee_plane = frame_to_rhino_plane(ee_frame)
print(ee_frame.quaternion.xyzw)
ee_framek = Frame([0.0110607,0.00809854,0.41498], [0,1,0], [1,0,0])
print(ee_framek.quaternion.xyzw)
# ---------- end tool ----------
remove = Button()
attach = Button()
mesh = Mesh(tool.M)
attach_tool = Python3Script(robot=robot, tool=tool.tool, attach=attach, remove=remove)  # -> tool, M, ee_plane, bang
# ---------- attach_tool: Python ----------
print(robot.get_group_names_from_link_name("robot_arm_flange"))

if attach:
    for planning_group in robot.get_group_names_from_link_name("robot_arm_flange"):
        robot.attach_tool(tool, group=planning_group)
if remove:
    for planning_group in robot.get_group_names_from_link_name("robot_arm_flange"):
        robot.detach_tool(group=planning_group)
# ---------- end attach_tool ----------

sort = SortList(Keys=py3_6.reuleaux_indices, ValuesA=py3_6.planes)  # -> Keys, ValuesA
item = ListItem(List=sort.ValuesA, Index=0, Wrap=True)  # -> Item1, Item
ideal_pose = Plane(item.Item1)

manual = Slider(20, range=0..100)
list_7 = ValueList({"Manual input": 0, "Ideal pose": 1}, selected="Manual input")
cp_2 = ClosestPoint(Point=ideal_pose, Cloud=pl_2)  # -> ClosestPoint, CPIndex, Distance
filter = StreamFilter(Gate=list_7, Stream0=manual, Stream1=cp_2.CPIndex)
py3_8 = Python3Script(base_map=py3_5.base_map, reachabilitymap=visualize_map.reachabilitymap, idx=filter, show=Toggle(True))  # -> out, base_plane, reuleaux_points, reuleaux_data, reuleaux_index, reachability_indices, points, values
# ---------- py3_8: Python ----------
__author__ = "Gido"
__version__ = "2023.09.12"

import rhinoscriptsyntax as rs
from compas_ghpython.drawing import draw_frame, draw_points

planes = []
reuleaux_indices = []
if show:
    i = 0
    for node, data in base_map.base_map.nodes(data=True):
        if i == idx:
            base_plane = draw_frame(data['frame'])
            reuleaux_index = data['mean_reuleaux_index']
            reuleaux_data = data['reuleaux_data']
            reuleaux_points = draw_points([{'pos': [pt.x, pt.y, pt.z]} for pt in reuleaux_data['reuleaux_points']])
            reachability_indices = [ri for point, ri in reachabilitymap.spheres_data(yield_ri=True)]
            points = draw_points([{'pos': [pt.x, pt.y, pt.z]} for pt in reuleaux_data['goal_points']])
            values = reuleaux_data['goal_reuleaux_index']
            break
        i += 1
# ---------- end py3_8 ----------
base_pose = Plane(py3_8.base_plane)

# ---- group: Reachability of evaluated goal_points
bnd_2 = Bounds(Numbers=py3_8.values)
dedomain_2 = DeconstructDomain(Domain=bnd_2)  # -> Start, End
gradient_3 = Gradient(
    LowerLimit=0,
    UpperLimit=dedomain_2.End,
    Parameter=py3_8.values,
    stops=[0.001: RGB(0, 0, 0), 0.276: RGB(254, 244, 84), 0.75: RGB(173, 203, 249), 1: RGB(75, 107, 169)])
dots_3 = DotDisplay(Point=py3_8.points, Colour=gradient_3, Size=expr("x/10", Slider(0.8, range=0..1)))

# ----
# real robot values
subscribe = Button()
unsubscribe = Button()
get_joint_states = Python3Script(robot=robot, subscribe=subscribe, unsubscribe=unsubscribe)
# ---------- get_joint_states: Python ----------
if subscribe:
    robot.mobile_client.joint_states_subscribe()

if unsubscribe:
    robot.mobile_client.joint_states_unsubscribe()

#robot.mobile_client.tf_subscribe("robot_arm_base", "robot_base_footprint")
#print('x')
# ---------- end get_joint_states ----------
trigger = Trigger(Interval=2000, TimerInterval=2000, Target=draw)  # disabled
draw = Python3Script(robot=robot)  # -> configuration
# ---------- draw: Python ----------
from compas_robots import Configuration

configuration = robot.mobile_client.get_current_configuration()
print(configuration)
# ---------- end draw ----------

number_slider_3 = Slider(0, range=0..0.8)

# ----
# Configuration
# zero configuration
zero = Python3Script(robot=robot, group=info.main_group_name)  # -> out, configuration; inputs group: String
# ---------- zero: Python ----------
configuration = robot.zero_configuration(group)
# ---------- end zero ----------

# ----
# forward kinematics
number_slider_4 = Slider(18.8, range=-180..180)
forward_kinematics = Python3Script(
    robot=robot,
    lift=number_slider_3,
    j1=number_slider_4,
    j2=Slider(-137.4, range=-360..360),
    j3=Slider(-98, range=-180..180),
    j4=Slider(5, range=-400..400),
    j5=Slider(88, range=-125..120),
    j6=Slider(54, range=-400..400))  # -> configuration
# ---------- forward_kinematics: Python ----------
import math

from compas_robots.model import Joint
from compas_robots import Configuration


if robot:
    joint_types = robot.get_configurable_joint_types()
    joint_names = robot.get_configurable_joint_names()

    joint_values = [j1, j2, j3, j4, j5, j6]
    for i, joint_value in enumerate(joint_values):
        joint_values[i] = math.radians(joint_values[i])
    
    if len(robot.get_configurable_joints()) == 6:
        configuration = Configuration(joint_values, joint_types, joint_names)
    else:
        configuration = Configuration.from_prismatic_and_revolute_values([lift], joint_values)
    print (configuration)
# ---------- end forward_kinematics ----------

# ----
# analytical inverse kinematics
select_configuration = Slider(0, range=0..7)
plane_2 = Plane(base_plane_2)
analytic_inverse = Python3Script(robot=robot, lift=number_slider_3, plane=plane_2, idx=select_configuration)  # -> out, configuration, plane_RCF, plane_tool0_RCF; inputs plane: Plane, idx: Int32
# ---------- analytic_inverse: Python ----------
import Rhino.Geometry as rg
import math
from compas.geometry import Frame, Transformation, Rotation
from compas_robots import Configuration
from ur_fabrication_control.kinematics.ur_kinematics import inverse_kinematics
from ur_fabrication_control.kinematics.ur_params import ur_params
from compas_rhino.conversions import plane_to_compas_frame
from compas_ghpython.drawing import draw_frame

# transform frame to robot coordinate system
frame_WCF = plane_to_compas_frame(plane)
frame_BCF = robot.from_WCF_to_BCF(frame_WCF)
frame_RCF = robot.from_WCF_to_RCF(frame_BCF)

if robot.attached_tool:
    tool0_RCF = robot.from_tcf_to_t0cf([frame_RCF])[0]
else:
    tool0_RCF = frame_RCF

plane_tool0_RCF = draw_frame(tool0_RCF)
plane_RCS = draw_frame(frame_RCF)
# print(plane_RCS)

# calculate solutions to frame
ur_params = ur_params["ur20"] # get the parameters according to the robot model
# print ur_params
solutions = inverse_kinematics(tool0_RCF, ur_params)
# print solutions

if not len(solutions):
    joint_values = [0, 0, 0, 0, 0, 0]
else:
    joint_values = solutions[idx]

if len(robot.get_configurable_joints()) == 6:
    configuration = Configuration.from_revolute_values(joint_values)
else:
    configuration = Configuration.from_prismatic_and_revolute_values([lift], joint_values)

print(configuration)
# ---------- end analytic_inverse ----------

# ----
# inverse kinematics
list_8 = ValueList({"ur20", "ur20_and_liftkit"}, selected="ur20_and_liftkit")
compute = Button()
inverse = Python3Script(robot=robot, plane=plane_2, group=list_8, compute=compute)  # -> out, configuration
# ---------- inverse: Python ----------
"""
Calculate the robot's inverse kinematic for a given plane.

COMPAS FAB v1.0.2
"""

from compas_rhino.conversions import plane_to_compas_frame
from ghpythonlib.componentbase import executingcomponent as component
from scriptcontext import sticky as st


class InverseKinematics(component):
    def RunScript(self, robot, plane, start_configuration, group, compute):
        key = "inverse_solution"
        configuration = None
        if robot and robot.client and robot.client.is_connected and plane and compute:
            frame = plane_to_compas_frame(plane)
            configuration = robot.inverse_kinematics(frame, start_configuration, group)
            st["inverse_solution"] = configuration
        configuration = st.get("inverse_solution", None)
        return configuration
# ---------- end inverse ----------

pln_3 = Plane(analytic_inverse.plane_RCF)
show_rcf = BooleanToggle(True)
show_robot_collision = BooleanToggle(False)

# ----
# Visualisation
list_9 = ValueList({"0 zero_configuration": 0, "1 forward_kinematics": 1, "2 analytic_inverse_kinematics": 2, "3 inverse_kinematics": 3, "4 motion_planning": 4, "5 real_configuration": 5}, selected="2 analytic_inverse_kinematics")
filter_2 = StreamFilter(
    Gate=list_9,
    Stream0=zero.configuration,
    Stream1=forward_kinematics,
    Stream2=analytic_inverse.configuration,
    Stream3=inverse.configuration,
    Stream5=draw)
show_eef = BooleanToggle(True)
show_frames = BooleanToggle(True)
show_visual = BooleanToggle(True)
show_collision = BooleanToggle(True)
show_attached_collision = BooleanToggle(True)
show_bcf = BooleanToggle(True)
visualise = Python3Script(
    robot=robot,
    configuration=filter_2,
    show_frames=show_frames,
    show_visual_meshes=show_visual,
    show_robot_collision_meshes=show_robot_collision,
    show_collision_meshes=show_collision,
    show_attached_collision_meshes=show_attached_collision,
    show_BCF=show_bcf,
    show_RCF=show_rcf,
    show_EEF=show_eef,
    bang=[set_frame, attach_tool.bang])  # -> out, joint_planes, visual_meshes, robot_collision_meshes, collision_meshes, attached_meshes, BCF, RCF, EEF; inputs bang: list
# ---------- visualise: Python ----------
from scriptcontext import sticky as st
import time
from compas_ghpython import create_id
from compas.geometry import Frame
from compas.geometry import Transformation
from compas_rhino.conversions import frame_to_rhino, mesh_to_compas, mesh_to_rhino, frame_to_rhino_plane
from compas.scene import SceneObject
from compas_fab.robots import PlanningScene
import Rhino.Geometry as rg
import ghpythonlib.components as ghcomp

robot.update(configuration)

if show_frames == True: 
    #print(configuration)
    joint_frames = robot.model.transformed_frames(configuration)
    joint_planes = [frame_to_rhino(a) for a in joint_frames]

if show_BCF:
    BCF = frame_to_rhino(robot.BCF)

if show_RCF:
    print(robot.RCF)
    RCF = frame_to_rhino(robot.from_BCF_to_WCF(robot.RCF))

if show_EEF:
    EEF = frame_to_rhino(robot.from_BCF_to_WCF(robot.forward_kinematics(
        configuration, options=dict(solver="model")
        )))

if show_visual_meshes == True:
    visual_meshes = robot.draw_visual()
    # orient the robot to its base plane:
    robot_BCF = frame_to_rhino_plane(robot.BCF) 
    print(type(robot_BCF))
    init_robot_plane = rg.Plane.WorldXY
    #visual_meshes = ghcomp.Orient(visual_meshes, init_robot_plane, robot_BCF)[0]

if show_robot_collision_meshes == True:
    robot_collision_meshes = robot.draw_collision()

cached_scene_key = "cached_scene"

if show_collision_meshes or show_attached_collision_meshes:
    cached_scene = st.get(cached_scene_key)
    if not cached_scene:
        cached_scene = {"time": 0}

    # # expire cache if the component has not been executed in the last 2 seconds
    # # this allows to slide through a list of configurations
    # # without triggering refreshes of the scene in the middle of it

    # if time.time() - cached_scene["time"] > 2:
    #     update_scene = True
    # else:
    #     update_scene = False

    update_scene = True

    if update_scene:
        scene = PlanningScene(robot)
        scene = robot.client.get_planning_scene()

    if update_scene and show_collision_meshes:
        collision_meshes = []

        for co in scene.world.collision_objects:
            print(co)
            header = co.header
            frame_id = header.frame_id
            cms = co.to_collision_meshes()

            for cm in cms:
                if cm.frame != Frame.worldXY():
                    t = Transformation.from_frame(cm.frame)
                    mesh = cm.mesh.transformed(t)
                else:
                    mesh = cm.mesh
                collision_meshes.extend(SceneObject(item=mesh).draw())

        cached_scene["cm"] = collision_meshes

        collision_meshes = cached_scene.get("cm", [])

    if update_scene and show_attached_collision_meshes:
        attached_meshes = []

        for aco in scene.robot_state.attached_collision_objects:
            for acm in aco.to_attached_collision_meshes():
                frame_id = aco.object["header"]["frame_id"]
                frame = robot.forward_kinematics(configuration, options=dict(link=frame_id))
                t = Transformation.from_frame(frame)

                # Local CM frame
                if acm.collision_mesh.frame and acm.collision_mesh.frame != Frame.worldXY():
                    t = t * Transformation.from_frame(acm.collision_mesh.frame)

                mesh = acm.collision_mesh.mesh.transformed(t)

                attached_meshes.extend(SceneObject(item=mesh).draw())

        cached_scene["acm"] = attached_meshes

        attached_meshes = cached_scene.get("acm", [])
    
    cached_scene["time"] = time.time()
    st[cached_scene_key] = cached_scene
# ---------- end visualise ----------
py3_9 = Python3Script(planes=[visualise.BCF, visualise.RCF, visualise.EEF], scale=Slider(0.2, range=0..1))  # -> P, V, C, W; inputs planes: list of Plane, scale: Double
# ---------- py3_9: Python ----------
from Rhino.Display import ColorRGBA
from ghpythonlib.components import ColourRGBf


red = ColourRGBf(255, 255, 0, 0)
green = ColourRGBf(255, 0, 255, 0)
blue = ColourRGBf(255, 0, 0, 255)

P = []
V = []
C = []

# scale = float(scale)

for plane in planes:
    if not plane:
        continue
    P += [plane.Origin] * 3
    V.append(plane.XAxis * scale)
    V.append(plane.YAxis * scale)
    V.append(plane.ZAxis * scale)
    C += [red, green, blue]

W = 3
# ---------- end py3_9 ----------
pln_4 = Plane(visualise.joint_planes)
mesh_2 = Mesh(visualise.visual_meshes)
mesh_3 = Mesh(visualise.collision_meshes)
orient = Orient(Geometry=visualise.visual_meshes, Source=PlaneXY(0, 0, 0), Target=visualise.BCF)  # -> Geometry, Transform
vdisex = VectorDisplayEx(Point=py3_9.P, Vector=py3_9.V, Colour=py3_9.C, Width=py3_9.W)
preview_4 = CustomPreview(Geometry=orient.Geometry, Material=ColourSwatch(SwatchColor=RGB(74, 74, 74)))

mesh_4 = Mesh(visualise.robot_collision_meshes)
mesh_5 = Mesh(visualise.attached_meshes)
