# Grasshopper definition 03_robot_localisation.ghx (Grasshopper 1.0.8)

# ----
# Design from curve
number_slider = Slider(0.35, range=0..1)
crv = Curve(<curve referenced from the Rhino model>)
division = Division(A=number_slider, B="2")
divlength = DivideLength(Curve=crv, Length=division)  # -> Points, Tangents, Parameters

# ----
# Create a part
toggle = BooleanToggle(True)
part = Python3Script()  # -> out, part
# ---------- part: Python ----------
from compas.geometry import Frame, Vector, Box
from compas.geometry import Transformation, Translation
# from assembly_information_model import Part

from qut_assembly import MarkedPart

# dimensions
width = 0.07
length = 0.30
height = 0.035

# create parte
center_frame = Frame([0., 0., 0.], [0, -1, 0], [1, 0, 0]) #center of the box frame 
part_geometry = Box(width, length, height, center_frame, 'box')

    #create pick plane for gripper
offset = Vector (0,width/2,0)
pick_plane = Frame(center_frame.point + offset, center_frame.xaxis, center_frame.yaxis)


part = MarkedPart.from_shape(part_geometry, name="Part", frame=pick_plane)
part.height = height

marker_offset_x = 0.010
marker_offset_y = -0.005
marker_offset_z = 0
Tvec = Vector(marker_offset_x, marker_offset_y, marker_offset_z)
part.marker_frame = center_frame.transformed(Translation.from_vector(Tvec))
# ---------- end part ----------
show = Python3Script(my_part=part.part, show=toggle)  # -> out, plane, mesh
# ---------- show: Python ----------
from compas_rhino.conversions import mesh_to_rhino, box_to_rhino, frame_to_rhino


if show:

    #extract the mesh of the part for visulization
    compas_mesh = my_part.mesh
    #convert to rhino mesh
    mesh = mesh_to_rhino(compas_mesh)
    
    #extract the frame of the part for visulization
    frame = my_part.frame
    #convert to rhino plane
    plane = frame_to_rhino(frame)
# ---------- end show ----------
pln = Plane(show.plane)
geo = Geometry(show.mesh)

# ----
# Unload Python modules
button = Button()
unload = Python3Script(unload=button)  # -> out, a
# ---------- unload: Python ----------
from compas_rhino import unload_modules

unload_modules('assembly_information_model')
unload_modules('assembly_information_model.assembly')
unload_modules('assembly_information_model.part')
unload_modules('qut_assembly')
# ---------- end unload ----------

Z = UnitZ(Factor=1)
xprod = CrossProduct(VectorA=divlength.Tangents, VectorB=Z, Unitize=False)  # -> Vector, Length
pl = ConstructPlane(Origin=divlength.Points, XAxis=divlength.Tangents, YAxis=xprod.Vector)
pln_2 = Plane(pl)

# ----
# Transform part
merge = Merge()
create_parts = Python3Script(part=part.part, planes=pln_2)  # -> out, parts; inputs planes: list of Plane
# ---------- create_parts: Python ----------
from compas.geometry import Frame, Transformation
from compas_rhino.conversions import plane_to_compas_frame

frames = [plane_to_compas_frame(plane) for plane in planes]
print(frames)
parts = []
for frame in frames:
    T = Transformation.from_frame_to_frame(Frame.worldXY(), frame)
    parts.append(part.transformed(T))
# ---------- end create_parts ----------

# ----
# Create the assembly
toggle_2 = BooleanToggle(True)
assembly = Python3Script(create=toggle_2, parts=create_parts.parts)  # -> out, assembly; inputs parts: list
# ---------- assembly: Python ----------
import math

from compas.geometry import Frame, Point
from compas.geometry import Transformation, Rotation, Translation
from compas_rhino.conversions import plane_to_compas_frame

from assembly_information_model.assembly import Assembly

if create:
    #create empty assembly
    assembly = Assembly()

    for part in parts:
        assembly.add_part(part)
# ---------- end assembly ----------

cp = Plane(PlaneXY(0.4, 0.4, 0))
cp_new = Plane(PlaneXY(0.8, 0.4, 0))
transform = Python3Script(assembly=assembly.assembly, transform=Toggle(False), center_plane=cp, center_plane_new=cp_new)  # -> out, assembly
# ---------- transform: Python ----------
from compas.geometry import Frame, Transformation, Rotation, Translation
from compas_rhino.conversions import plane_to_compas_frame

center_frame = plane_to_compas_frame(center_plane)
center_frame_new = plane_to_compas_frame(center_plane_new)


if transform:
    T = Transformation.from_frame_to_frame(center_frame, center_frame_new)
    assembly = assembly.transformed(T)
# ---------- end transform ----------

Z_2 = UnitZ(Factor=Slider(0.035, range=0..0.1))
sift = SiftPattern(List=pl, SiftPattern=[0, 1])  # -> Output0, Output1
move = Move(Geometry=sift.Output1, Motion=Z_2)  # -> Geometry, Transform
entwine = Entwine(Branch00=sift.Output0, Branch01=move.Geometry, FlattenInputs=True)

reset = Button()
back = Button()
start = Button()
stop = Button()
step = Button()
full = Button()
list = ValueList({"20", "50", "100", "500", "1000", "5000"}, selected="500")
counter = Python3Script(assembly=transform.assembly, start=start, stop=stop, step=step, step_back=back, reset=reset, full=full, interval=list)  # -> out, counter
# ---------- counter: Python ----------
from scriptcontext import sticky as st
import Grasshopper

def update_component(ghenv, delay):
    """Schedule an update of the Grasshopper component.

    After the specified delay, the GH component will be automatically updated.

    Parameters
    ----------
    ghenv : :class:`GhPython.Component.PythonEnvironment`
        The current GHPython environment.
    delay : :obj:`int`
        Time in milliseconds until the update is performed.

    Raises
    ------
    ValueError
        If the delay is less than zero.

    """
    if delay <= 0:
        raise ValueError("Delay must be greater than zero")

    ghcomp = ghenv.Component
    ghdoc = ghcomp.OnPingDocument()

    def callback(ghdoc):
        if ghdoc.SolutionState != Grasshopper.Kernel.GH_ProcessStep.Process:
            ghcomp.ExpireSolution(False)

    ghdoc.ScheduleSolution(delay, Grasshopper.Kernel.GH_Document.GH_ScheduleDelegate(callback))

L = range(assembly.graph.number_of_nodes())

# store data in component
guid = str(ghenv.Component.InstanceGuid)
counter_key = "counter_" + guid
running_key = "running_" + guid

if counter_key not in st:
    st[counter_key] = 0

if running_key not in st:
    st[running_key] = False
    

if st[running_key]:
    if st[counter_key] < len(L) - 1:
        st[counter_key] += 1
        update_component(ghenv, interval)
    else:
        st[counter_key] = 0
        st[running_key] = False
    
if start:
    st[running_key] = True

if stop:
    st[running_key] = False

if step:
    if st[counter_key] < len(L) - 1:
        st[counter_key] += 1

if step_back:
    if st[counter_key] < len(L) - 1:
        st[counter_key] -= 1

if reset:
    st[counter_key] = 0
    st[running_key] = False

if full:
    st[counter_key] = len(L)-1

if len(L):
    item = L[st[counter_key]]


#st["visualisation_counter"] = st[counter_key]
counter = st[counter_key]+1
# ---------- end counter ----------
panel = Panel(counter.counter)

# ----
# Draw
list_2 = ValueList({"show all": "show_all", "show until key": "show_until_key"}, selected="show until key")
visualize = Python3Script(assembly=transform.assembly, show=list_2, highlight_current_part=Toggle(True), counter=counter.counter)  # -> out, parts_geometry, parts_frame, current_part_geometry, current_part_frame
# ---------- visualize: Python ----------
from compas_rhino.conversions import mesh_to_rhino, box_to_rhino, frame_to_rhino

#print assembly
print(assembly)

#get parts datastructure
parts = [p for p in assembly.parts()]

#get current part



if show == "show_all":
    
    #extract the mesh of the parts for visulization (+ converted to rhino mesh)
    parts_geometry = [mesh_to_rhino(p.mesh) for p in parts]
    
    #extract the frame of the parts for visulization (+ converted to rhino plane)
    parts_frame = [frame_to_rhino(p.frame) for p in parts]

    key = assembly.graph.number_of_nodes()-1

if show == "show_until_key":
    #extract the mesh of the parts for visulization (+ converted to rhino mesh)
    parts_geometry = [mesh_to_rhino(p.mesh) for p in parts[0:counter]]
    
    #extract the frame of the parts for visulization (+ converted to rhino plane)
    parts_frame = [frame_to_rhino(p.frame) for p in parts[0:counter]]

    key = counter-1

if highlight_current_part:
    current_part = assembly.part(key)
    current_part_geometry = mesh_to_rhino(current_part.attributes["mesh"])
    current_part_frame = frame_to_rhino(current_part.frame)
# ---------- end visualize ----------
panel_2 = Panel(visualize.out)
geo_2 = Geometry([visualize.current_part_geometry, visualize.current_part_frame])
geo_3 = Geometry(visualize.parts_frame)
geo_4 = Geometry(visualize.parts_geometry)
preview = CustomPreview(Geometry=geo_3, Material=ColourSwatch(SwatchColor=RGB(255, 125, 157)))
preview_2 = CustomPreview(Geometry=geo_4, Material=ColourSwatch(SwatchColor=RGBA(255, 227, 227, 233)))
preview_3 = CustomPreview(Geometry=geo_2, Material=ColourSwatch(SwatchColor=RGB(255, 125, 157)))

# ----
# Test0:
# Relative localisation
panel_3 = Panel("""0
2
1""")
planes_from_pos1 = Plane([Plane(origin=(-0.7264976844, 0.9814784683, 0.7172778467), x=(-0.9999504153, -0.009578716196, 0.002723084142), y=(0.0007177498621, -0.3420638252, -0.9396764466)), Plane(origin=(-0.5987894711, 0.8847935955, 0.7159783007), x=(-0.8553776894, -0.4572123465, 0.2434869168), y=(-0.2969043001, 0.04756322745, -0.9537219595)), Plane(origin=(-0.7894762094, 0.8333397777, 0.7191095685), x=(-0.8746663486, -0.4481425703, 0.1847349867), y=(-0.2502692174, 0.09113198671, -0.9638777307))])
planes_from_pos2 = Plane([Plane(origin=(-0.02751055198, 1.114145736, 0.7130240623), x=(-0.9900123749, -0.1385002908, -0.02632806361), y=(0.1153229033, -0.6881689803, -0.7163267987)), Plane(origin=(-0.144116818, 1.001267182, 0.7159071165), x=(-0.9943886603, -0.102600156, 0.02577596184), y=(-0.0004877884279, -0.2392062609, -0.9709686539)), Plane(origin=(0.05106142115, 0.9736820893, 0.7157997976), x=(-0.5319456944, -0.8263172255, 0.1850232988), y=(0.002559048193, -0.220070351, -0.9754806466)), Plane(origin=(-0.05250908825, 0.8592242854, 0.7133874782), x=(-0.9659227821, -0.254143744, 0.04903199278), y=(-0.2458198177, 0.841452839, -0.4811753702))])
xy = XYPlane(Origin=Point(0, 0, 0))
panel_4 = Panel("""8
5
2""")
panel_5 = Panel("""8
2
5
3""")
item = ListItem(List=planes_from_pos2, Index=panel_3, Wrap=True)

# ----
# IP Settings
# --> Set your IP address (server_ip)
# --> Set robot IP address
server_ip = ValueList({"192.168.0.22"}, selected="192.168.0.22")
ur_ip = ValueList({"192.168.0.118", "127.0.0.1", "192.168.56.101"}, selected="192.168.0.118")
server_port = ValueList({"50002", "50003", "50005", "50006", "50007", "50008", "50009", "50010", "50011", "50012", "50013", "50014", "50015", "50016", "50017", "50018", "50019", "50020", "50021", "50022", "50023", "50024", "50025", "50026", "50027", "50028"}, selected="50006")
ur_port = ValueList({"30002"}, selected="30002")
globals = Python3Script(server_ip=server_ip, server_port=server_port, ur_ip=ur_ip, ur_port=ur_port, clear=Button())  # inputs server_ip: String, server_port: Int32, ur_ip: String, ur_port: Int32
# ---------- globals: Python ----------
from scriptcontext import sticky as st

st["server_ip"] = server_ip
st["server_port"] = server_port

st["ur_ip"] = ur_ip
st["ur_port"] = ur_port

if clear:
    st.clear()
# ---------- end globals ----------

# ----
# Check if UR robot
#  is available
ping = Button()
ping_2 = Python3Script(ip=ur_ip, ping=ping)  # -> out; inputs ip: String
# ---------- ping_2: Python ----------
from scriptcontext import sticky as st
from ur_fabrication_control.direct_control.utilities import is_available

guid = str(ghenv.Component.InstanceGuid)
txt_key = "txt_" + guid
if txt_key not in st:
    st[txt_key] = ""

if ping:
    
    available = is_available(ip)
    
    if available:
        st[txt_key] = "%s is up!" % ip
        trigger = True
    else:
        st[txt_key] = "%s is down!" % ip
        trigger = False

print(st[txt_key])
# ---------- end ping_2 ----------
panel_6 = Panel(ping_2)

# ----
# Update robot base location
base_plane = Plane(Plane(origin=(1.276877991, 1.759565459, 0), x=(-0.4144677566, 0.9100639971, 0), y=(-0.9100639971, -0.4144677566, 0)))
# Update tool target
base_plane_2 = Plane(visualize.current_part_frame)
list_3 = ValueList({"local": "127.0.0.1", "linux computer": "192.168.0.222", "linux eduroam": "10.181.95.254", "linux ccnet": "192.168.0.102", "linux vmware": "192.168.199.36", "robot": "192.168.0.200", "robotAA_wifi": "192.168.0.111", "robotAB_wifi": "192.168.0.112", "robotAB_eduroam": "10.181.67.95"}, selected="linux computer")

# ----
# ROS client
panel_7 = Panel("9090")
connect = BooleanToggle(True)
ros = Python3Script(ip=list_3, port=panel_7, connect=connect)  # -> out, ros_client, is_connected; inputs ip: String, port: Int32, connect: Boolean
# ---------- ros: Python ----------
"""
Connect or disconnect to ROS.

COMPAS FAB v0.27.0
"""
from scriptcontext import sticky as st

from compas_fab.backends import RosClient

ros_client = None

ip = ip or '127.0.0.1'
port = port or 9090
key = "ros_client_002"
ros_client = st.get(key, None)

if ros_client:
    st[key].close()
if connect:
    st[key] = RosClient(ip, port)
    st[key].run(5)

ros_client = st.get(key, None)
is_connected = ros_client.is_connected if ros_client else False
# ---------- end ros ----------
panel_8 = Panel(ros.is_connected)

# ----
# Test1:
# Localizing based on environment markers
planes_tool_pose1 = Plane([Plane(origin=(0.4722814349, 1.099050665, -0.0302259277), x=(-0.8921164921, -0.4508035226, -0.03007238658), y=(-0.1012010832, 0.1345151331, 0.9857301962)), Plane(origin=(1.501525505, 1.074815745, -0.01910691212), x=(-0.948100326, -0.3177489372, 0.01189053067), y=(-0.02257767963, 0.1045737383, 0.9942608217))])
planes_tool_pose2 = Plane([Plane(origin=(1.318597054, 0.1074763364, 0.03037312852), x=(-0.4649677162, 0.8832054438, -0.06126309511), y=(0.132328905, 0.1377524743, 0.9815871417)), Plane(origin=(1.310786179, -0.9210047386, 0.07748987099), x=(-0.3328472051, 0.9427405456, -0.02128383831), y=(0.1036414008, 0.05900741476, 0.9928628229))])
planes_tool_pose3 = Plane([Plane(origin=(1.457797834, -0.9298883322, -0.01475505439), x=(-0.9870001309, -0.09411781426, -0.1302788496), y=(-0.1176975413, -0.1287161209, 0.9846722546)), Plane(origin=(0.4269439583, -0.9083605091, -0.04015291834), x=(-0.9821663631, 0.1540927203, -0.1077249681), y=(-0.1238342311, -0.09905700652, 0.9873463388))])
merge_2 = Merge(Data1=planes_tool_pose1, Data2=planes_tool_pose2, Data3=planes_tool_pose3)
environment_markers = Point([<point referenced from the Rhino model> x5])
cullpt = CullDuplicates(Points=merge_2, Tolerance=Slider(0.2, range=0..1), CullMode=3)  # -> Points, Indices, Valence

save_to_file = Button()
measured_points = Point(cullpt.Points)
filepath = FilePath("C:\Users\gido\Documents\qut_workspace\workshop_qut_mobile_robots\data\source_points.ply")

save_to_file_2 = Button()
reference_points = Point(environment_markers)
filepath_2 = FilePath("C:\Users\gido\Documents\qut_workspace\workshop_qut_mobile_robots\data\reference_points.ply")

reload = Button()
# ROBOT
py3 = Python3Script()  # -> HERE, DATA, ROBOT_DESCRIPTION
# ---------- py3: Python ----------
import os

HERE = os.path.dirname(ghdoc.Path)
DATA = os.path.abspath(os.path.join(HERE, "..", "data"))
ROBOT_DESCRIPTION = os.path.abspath(os.path.join(DATA, "robot_description"))

print(HERE)
print(DATA)
print(ROBOT_DESCRIPTION)
# ---------- end py3 ----------
reload_2 = Python3Script(reload=reload)  # -> out
# ---------- reload_2: Python ----------
if reload:
    from compas_rhino import unload_modules
    unload_modules("assembly_information_model")
    unload_modules("mobile_robot_control")
    unload_modules('ur_fabrication_control')
# ---------- end reload_2 ----------

# ----
# Base pose search
rec = Rectangle({Plane=PlaneXY(2.441377483, 2.322391874, 0), Size=Domain2(u=-2.072133871..2.072133871, v=-0.7090924911..0.7090924911)})
dam = DataDam(DataSelected_planes=merge, BufferDelay=10000000, BufferMode=0)

# ----
# Reachabilitymap from JSON
# Point measuring
list_4 = ValueList({"ur10e_map.json", "rbvogui_xl_ur10e_and_liftkit": "rbvogui_xl_ur10e_and_liftkit.json", "rbvogui_xl_ur10e_and_liftkit_0_4": "rbvogui_xl_ur10e_and_liftkit_0_4.json", "rbvogui_xl_ur10e_and_liftkit_earthex_0_4": "rbvogui_xl_ur10e_and_liftkit_earthex_0_4.json", "rbvogui_xl_ur10e_and_liftkit_earthex_0_4_compas2.json"}, selected="rbvogui_xl_ur10e_and_liftkit_earthex_0_4_compas2.json")
py3_2 = Python3Script()  # -> DATA
# ---------- py3_2: Python ----------
import os

package_path = ghdoc.Path
# .stl files not stored in am_hackathon repo. but in mobile_fabrication_control
DATA = os.path.abspath(os.path.join(package_path,"../../data/reachabilitymaps"))

print(package_path)
print(DATA)
# ---------- end py3_2 ----------
py3_3 = Python3Script(DATA=py3_2, file=list_4)  # -> out, filepath
# ---------- py3_3: Python ----------
__author__ = "Gido"
__version__ = "2023.04.18"

import os
import rhinoscriptsyntax as rs

filepath = os.path.join(DATA, file)
assert filepath
# ---------- end py3_3 ----------
load_map = Python3Script(filepath=py3_3.filepath, load=Toggle(True))  # -> out, reachabilitymap
# ---------- load_map: Python ----------
__author__ = "Gido"
__version__ = "2023.04.18"

import rhinoscriptsyntax as rs
from compas.geometry import Point, Frame
from base_positioning import ReuleauxReachability, WsSphere
import json

if load:
    reachabilitymap = ReuleauxReachability.from_json(filepath)
# ---------- end load_map ----------
visualize_map = Python3Script(reachabilitymap=load_map.reachabilitymap)  # -> out, reachabilitymap, sphere_points, resolution, reachability_index
# ---------- visualize_map: Python ----------
__author__ = "Gido"
__version__ = "2023.04.17"

import rhinoscriptsyntax as rs

from compas.geometry import Frame
from compas_ghpython.drawing import draw_frame


sphere_points = []
reachability_index = []
for point, ri in reachabilitymap.spheres_data(yield_ri=True):
    sphere_points.append(draw_frame(Frame(point, [1,0,0], [0,1,0])))
    reachability_index.append(ri)
#sphere_points = draw_frames(sphere_frames)
if reachabilitymap.resolution != 0:
    resolution = reachabilitymap.resolution
else:
    resolution = 0.1
# ---------- end visualize_map ----------
gradient = Gradient(
    LowerLimit=0,
    UpperLimit=100,
    Parameter=visualize_map.reachability_index,
    stops=[0: RGB(234, 38, 0), 0.25: RGB(234, 126, 0), 0.5: RGB(254, 244, 84), 0.75: RGB(173, 203, 249), 1: RGB(75, 107, 169)])
dots = DotDisplay(Point=visualize_map.sphere_points, Colour=gradient, Size=Slider(0.07, range=0..0.15))

# ---- group: Create base pose grid
# Base poses
number_slider_2 = Slider(0.1, range=0..1)
py3_4 = Python3Script(rectangle=rec, resolution=number_slider_2)  # -> out, rpoints; inputs rectangle: Rectangle3d, resolution: Double
# ---------- py3_4: Python ----------
__author__ = "Gido"
__version__ = "2024.01.10"

import rhinoscriptsyntax as rs
from compas.geometry import Point, Pointcloud
from compas.geometry import Frame, Transformation, Translation
from compas.geometry import transform_points
from base_positioning import BaseMap

print(rectangle)

bm = BaseMap()
pc = bm.populate_rectangle(rectangle, resolution)

print(rectangle.Height)
print(rectangle.Width)
print(rectangle.Plane)

points_data = [{"pos":[pt.x, pt.y, pt.z]} for pt in pc.points]

from compas_ghpython.drawing import draw_points

rpoints = draw_points(points_data)
# ---------- end py3_4 ----------

# ----
# Record Markers
button_2 = Button()
path = FilePath("C:\Users\gido\Documents\qut_workspace\workshop_qut_mobile_robots\data\marker_locations.json")
py3_5 = Python3Script(
    ros_client=ros.ros_client,
    create=button_2,
    duration=Slider(0, range=0..10),
    filepath=path,
    start=Button(),
    stop=Button(),
    get_state=Button())  # -> out, start_time, end_time, is_recording, markers, tf_frames, tf_planes
# ---------- py3_5: Python ----------
import json
import roslibpy
import time
import traceback
import datetime
from multiprocessing import Queue
from scriptcontext import sticky as st


from mobile_robot_control.marker_utilities import MarkerRecorder

if "marker_recorder" not in st or create:
    markerrecorder = MarkerRecorder(ros_client, duration, output=filepath)
    st["marker_recorder"] = markerrecorder
else:
    markerrecorder = st["marker_recorder"]


start_time = time.strftime("%H:%m:%S", time.localtime(markerrecorder.start_time))
end_time = time.strftime("%H:%m:%S", time.localtime(markerrecorder.end_time))
is_recording = markerrecorder.is_recording
markers = markerrecorder.markers
markerrecorder.duration = duration

if start:
    if duration == 0:
        markerrecorder.duration_limited = False
    else:
        markerrecorder.duration_limited = True
    markerrecorder.start_recording()

if stop:
    markerrecorder.stop_recording()
# ---------- end py3_5 ----------
panel_9 = Panel(py3_5.start_time)
panel_10 = Panel(py3_5.end_time)
panel_11 = Panel(py3_5.is_recording)

# ----
# ROS client
list_5 = ValueList({"local": "127.0.0.1", "linux computer": "192.168.0.222", "linux eduroam": "10.181.95.254", "linux ccnet": "192.168.0.102", "linux vmware": "192.168.199.36", "robot": "192.168.0.200", "robotAA_wifi": "192.168.0.111", "robotAB_wifi": "192.168.0.112", "robotAB_eduroam": "10.181.67.95"}, selected="local")
connect_2 = BooleanToggle(True)
ros_2 = Python3Script(ip=list_5, port="9090", connect=connect_2)  # -> out, ros_client, is_connected; inputs ip: String, port: Int32, connect: Boolean
# ---------- ros_2: Python ----------
"""
Connect or disconnect to ROS.

COMPAS FAB v0.27.0
"""
from scriptcontext import sticky as st

from compas_fab.backends import RosClient

ros_client = None

ip = ip or '127.0.0.1'
port = port or 9090
key = "ros_client_001"
ros_client = st.get(key, None)

if ros_client:
    st[key].close()
if connect:
    st[key] = RosClient(ip, port)
    st[key].run(5)

ros_client = st.get(key, None)
is_connected = ros_client.is_connected if ros_client else False
# ---------- end ros_2 ----------
panel_12 = Panel(ros_2.is_connected)

# ----
# Load robot from ROS
load = Button()
# Make sure that ros bridge, file server, tf2_web_republisher and moveit config is running on the robot!
panel_13 = Panel("")
mobile_robot = Python3Script(ros_client=ros_2.ros_client, prefix=panel_13, load=load)  # -> out, mobile_robot; inputs prefix: String
# ---------- mobile_robot: Python ----------
"""
Load robot directly from ROS.

COMPAS FAB v0.27.0
"""
from mobile_robot_control.mobile_robot import MobileRobot
from mobile_robot_control.mobile_robot_client import MobileRobotClient
import compas_robots.ghpython

# from ghpythonlib.componentbase import executingcomponent as component
from scriptcontext import sticky as st
import Rhino
import scriptcontext

scriptcontext.doc = Rhino.RhinoDoc.ActiveDoc

from compas_robots import RobotModel
from compas.scene import SceneObject
# from compas_robots.ghpython.scene import RobotModelObject

scriptcontext.doc = ghdoc

key = 'robot_AA'
print(key)
if ros_client and ros_client.is_connected and load:
    # Load URDF from ROS
    robot = ros_client.load_robot(
            load_geometry=True, 
            urdf_param_name= '{}/robot_description'.format(prefix),
            srdf_param_name= '{}/robot_description_semantic'.format(prefix))
    robot.scene_object = SceneObject(item=robot.model)
    mobile_robot = MobileRobot(robot.model, robot.scene_object, robot.semantics, client=None)
    st[key] = mobile_robot

mobile_robot = st.get(key, None)
if mobile_robot:  # client sometimes need to be restarted, without needing to reload geometry
    mobile_robot.mobile_client = MobileRobotClient(ros_client)
    mobile_robot.client = ros_client
# ---------- end mobile_robot ----------

multitool = BooleanToggle(True)
update = Button()

robot = Data(mobile_robot.mobile_robot)
info = Python3Script(robot=robot)  # -> out, main_group_name
# ---------- info: Python ----------
if robot:
    robot.info()
    main_group_name = robot.main_group_name
# ---------- end info ----------
panel_14 = Panel(info.out)

# ----
# Get Pose Cartesian
# Make sure the robot is in remote_control and the Server_ip is set to your laptop's IP!
# Ensure you are using the correct tcp (camera)
get = Button()
pose = Python3Script(robot=robot, get=get)  # -> out, pose_cartesian
# ---------- pose: Python ----------
from scriptcontext import sticky as st

from ur_fabrication_control.direct_control.common import get_current_pose_cartesian
from compas.geometry import Frame


server_ip = st["server_ip"]
server_port = st["server_port"]
ur_port = st["ur_port"]
ur_ip = st["ur_ip"]
pose_cartesian_meter = []
print (ur_ip)

# retrieve the current tool frame in axis angle format
if robot.attached_tool:
    print ("attached")
    tool_angle_axis = list(robot.attached_tool.frame.point) + list(robot.attached_tool.frame.axis_angle_vector)
    
else:
    tool0_frame = Frame([0, 0, 0], [1, 0, 0], [0, 1, 0])
    tool_angle_axis = list(tool0_frame.point) + list(tool0_frame.axis_angle_vector)

guid = str(ghenv.Component.InstanceGuid)
pose_cartesian_key = "pose_cartesian" + guid


if get:
    print ("getting pose")
    st[pose_cartesian_key] = get_current_pose_cartesian(tool_angle_axis, server_ip, server_port, ur_ip, ur_port, send=True)
    

if pose_cartesian_key not in st:
    pose_cartesian = []
else:
    pose_cartesian = st[pose_cartesian_key]
# ---------- end pose ----------
panel_15 = Panel(pose.out)
record = Button()
clear = Button()
# here you can store multiple recorded positions
rec_2 = Python3Script(msg=pose.pose_cartesian, rec=record, clear=clear)  # -> out, record, planes; inputs msg: list
# ---------- rec_2: Python ----------
from scriptcontext import sticky as st
from compas.geometry import Frame
from compas_rhino.conversions import frame_to_rhino_plane

guid = str(ghenv.Component.InstanceGuid)
recorded_key =  "recorded_" + guid

if recorded_key not in st:
    st[recorded_key] = []

if clear:
    st[recorded_key] = []
else:
    if len(msg):
        if msg != [None] and rec:
            st[recorded_key].append(msg)


record = st[recorded_key]
planes = []
for pose in st[recorded_key]:
    frame = Frame.from_axis_angle_vector(pose[3:6], pose[0:3])
    planes.append(frame_to_rhino_plane(frame))
print (rec)
# ---------- end rec_2 ----------
panel_16 = Panel(rec_2.record)

list_6 = ValueList({"gripper", "camera", "scanner"}, selected="camera")

points_to_pcd = Python3Script(points=measured_points, filepath=filepath, write=save_to_file)  # -> out, pcd; inputs points: list of Point3d
# ---------- points_to_pcd: Python ----------
import open3d

array = [[x,y,z] for x, y, z in iter(points)]
pcd = open3d.geometry.PointCloud()
pcd.points = open3d.utility.Vector3dVector(array)
pcd.voxel_down_sample(0.0001)


if write:
    open3d.io.write_point_cloud(filepath, pcd, write_ascii=True)
    print("file written to ", str(filepath))
# ---------- end points_to_pcd ----------
measurements_source = Data(points_to_pcd.pcd)

points_to_pcd_2 = Python3Script(points=reference_points, filepath=filepath_2, write=save_to_file_2)  # -> out, pcd; inputs points: list of Point3d; same code as points_to_pcd
reference_target = Data(points_to_pcd_2.pcd)

vec2pt = Vector2Pt(PointA=graft(py3_4.rpoints), PointB=dam, Unitize=False)  # -> Vector, Length
ma = MassAddition(Input=vec2pt.Vector)  # -> Result, PartialResults
unit = UnitVector(Vector=ma.Result)  # -> flatten(Vector)
Z_3 = UnitZ(Factor="-1")
xprod_2 = CrossProduct(VectorA=unit, VectorB=Z_3, Unitize=False)  # -> Vector, Length
pl_2 = ConstructPlane(Origin=py3_4.rpoints, XAxis=unit, YAxis=xprod_2.Vector)

# ----
# Load Recorded Markers
path_2 = FilePath(path)
py3_6 = Python3Script(filepath=path_2, load=Toggle(True))  # -> out, markerset, planes; inputs filepath: String
# ---------- py3_6: Python ----------
import json
from compas.geometry import Frame
from compas_rhino.conversions import frame_to_rhino
from mobile_robot_control.markers import MarkerSet

with open(filepath, 'r') as f:
    data = json.load(f)

frames = []
markerset = MarkerSet("aruco")
for key, marker_data in data["markers"].items():
    # print(marker_data.keys())
    opt = marker_data["optimized"]
    t = opt.get("position")
    # print(t)
    q = opt.get("orientation")
    # print(q)
    frame = Frame.from_quaternion(
        quaternion = q,
        point = t
    )
    frames.append(frame)
    markerset.add_marker(key, t, q)
print(markerset.markers)
planes = [frame_to_rhino(f) for f in frames]
# ---------- end py3_6 ----------

# ----
# Transform markers from camera frame to base_footprint
number_slider_3 = Slider(0.275, range=0..1)
xy_2 = XYPlane(Origin=Point(0, 0, 0))
vec = VectorXYZ(XComponent=number_slider_3, YComponent=0, ZComponent=Slider(1.3, range=0..10))  # -> Vector, Length
xy_3 = XYPlane(Origin=Point(0, 0, 0))
move_2 = Move(Geometry=xy_2, Motion=vec.Vector)  # -> Geometry, Transform
rotate = Rotate(Geometry=xy_3, Angle=-1.570796327, Plane=PlaneXY(0, 0, 0))  # -> Geometry, Transform
orient = Orient(Geometry=rec_2.planes, Source=rotate.Geometry, Target=move_2.Geometry)  # -> Geometry, Transform
tool_plane_from_bcf = Plane(orient.Geometry)
orient_2 = Orient(Geometry=py3_6.planes, Source=PlaneXY(0, 0, 0), Target=tool_plane_from_bcf)  # -> Geometry, Transform

# ----
# Base Map Reuleaux Calculation
resolution = Slider(0.4, range=0..1)
py3_7 = Python3Script(goal_points=dam, base_poses=pl_2, reuleaux_map=load_map.reachabilitymap, map_resolution=resolution, compute=Toggle(True))  # -> out, base_map; inputs goal_points: list of Point3d, base_poses: list of Plane
# ---------- py3_7: Python ----------
__author__ = "Gido"
__version__ = "2023.09.12"

import rhinoscriptsyntax as rs
from compas.geometry import Frame, Pointcloud
from base_positioning import BaseMap
from compas_ghpython.drawing import draw_points

if compute:
    base_map = BaseMap()
    goal_pointcloud = Pointcloud(goal_points)
    # start_pointcloud = Pointcloud(start_points)
    if reuleaux_map.resolution == 0:
        reuleaux_map.resolution = map_resolution
    for base_pose in base_poses:
        base_frame = Frame(base_pose.Origin, base_pose.XAxis, base_pose.YAxis)
        
        base_map.get_reuleaux_index_by_base_pose(base_frame, reuleaux_map, goal_pointcloud)
# ---------- end py3_7 ----------
pt = Point(dam)
py3_8 = Python3Script(base_map=py3_7.base_map, points=pt, part_distance=Slider(0.7, range=0..1))  # -> out, base_map; inputs points: list of Point3d
# ---------- py3_8: Python ----------
from compas.geometry import Pointcloud

pc = Pointcloud(points)

key, data = base_map.get_ideal_pose_with_closeness_penalty(pc, distance=part_distance)
# ---------- end py3_8 ----------

measurements_source_2 = Data(measurements_source)
reference_target_2 = Data(reference_target)

# ----
# real robot values
subscribe = Button()
unsubscribe = Button()
get_joint_states = Python3Script(robot=robot, subscribe=subscribe, unsubscribe=unsubscribe)
# ---------- get_joint_states: Python ----------
if subscribe:
    robot.mobile_client.joint_states_subscribe()

if unsubscribe:
    robot.mobile_client.joint_states_unsubscribe()

#robot.mobile_client.tf_subscribe("robot_arm_base", "robot_base_footprint")
#print('x')
# ---------- end get_joint_states ----------
trigger = Trigger(Interval=2000, TimerInterval=2000, Target=draw)  # disabled
draw = Python3Script(robot=robot)  # -> configuration
# ---------- draw: Python ----------
from compas_robots import Configuration

configuration = robot.mobile_client.get_current_configuration()
print(configuration)
# ---------- end draw ----------

# ----
# Configuration
# zero configuration
zero = Python3Script(robot=robot, group=info.main_group_name)  # -> out, configuration; inputs group: String
# ---------- zero: Python ----------
configuration = robot.zero_configuration(group)
# ---------- end zero ----------

number_slider_4 = Slider(0, range=0..0.8)

# ----
# forward kinematics
number_slider_5 = Slider(54, range=-400..400)
forward_kinematics = Python3Script(
    robot=robot,
    lift=number_slider_4,
    j1=Slider(18.8, range=-180..180),
    j2=Slider(-137.4, range=-360..360),
    j3=Slider(-98, range=-180..180),
    j4=Slider(5, range=-400..400),
    j5=Slider(88, range=-125..120),
    j6=number_slider_5)  # -> configuration
# ---------- forward_kinematics: Python ----------
import math

from compas_robots.model import Joint
from compas_robots import Configuration


if robot:
    joint_types = robot.get_configurable_joint_types()
    joint_names = robot.get_configurable_joint_names()

    joint_values = [j1, j2, j3, j4, j5, j6]
    for i, joint_value in enumerate(joint_values):
        joint_values[i] = math.radians(joint_values[i])
    
    if len(robot.get_configurable_joints()) == 6:
        configuration = Configuration(joint_values, joint_types, joint_names)
    else:
        configuration = Configuration.from_prismatic_and_revolute_values([lift], joint_values)
    print (configuration)
# ---------- end forward_kinematics ----------

# ----
# analytical inverse kinematics
select_configuration = Slider(5, range=0..7)
plane = Plane(tool_plane_from_bcf)
analytic_inverse = Python3Script(robot=robot, lift=number_slider_4, plane=plane, idx=select_configuration)  # -> out, configuration, plane_RCF, plane_tool0_RCF; inputs plane: Plane, idx: Int32
# ---------- analytic_inverse: Python ----------
import Rhino.Geometry as rg
import math
from compas.geometry import Frame, Transformation, Rotation
from compas_robots import Configuration
from ur_fabrication_control.kinematics.ur_kinematics import inverse_kinematics
from ur_fabrication_control.kinematics.ur_params import ur_params
from compas_rhino.conversions import plane_to_compas_frame
from compas_ghpython.drawing import draw_frame

# transform frame to robot coordinate system
frame_WCF = plane_to_compas_frame(plane)
frame_BCF = robot.from_WCF_to_BCF(frame_WCF)
frame_RCF = robot.from_WCF_to_RCF(frame_BCF)

if robot.attached_tool:
    tool0_RCF = robot.from_tcf_to_t0cf([frame_RCF])[0]
else:
    tool0_RCF = frame_RCF

plane_tool0_RCF = draw_frame(tool0_RCF)
plane_RCS = draw_frame(frame_RCF)
# print(plane_RCS)

# calculate solutions to frame
ur_params = ur_params["ur20"] # get the parameters according to the robot model
# print ur_params
solutions = inverse_kinematics(tool0_RCF, ur_params)
# print solutions

if not len(solutions):
    joint_values = [0, 0, 0, 0, 0, 0]
else:
    joint_values = solutions[idx]

if len(robot.get_configurable_joints()) == 6:
    configuration = Configuration.from_revolute_values(joint_values)
else:
    configuration = Configuration.from_prismatic_and_revolute_values([lift], joint_values)

print(configuration)
# ---------- end analytic_inverse ----------

# ----
# inverse kinematics
list_7 = ValueList({"ur20", "ur20_and_liftkit"}, selected="ur20_and_liftkit")
compute = Button()
inverse = Python3Script(robot=robot, plane=plane, group=list_7, compute=compute)  # -> out, configuration
# ---------- inverse: Python ----------
"""
Calculate the robot's inverse kinematic for a given plane.

COMPAS FAB v1.0.2
"""

from compas_rhino.conversions import plane_to_compas_frame
from ghpythonlib.componentbase import executingcomponent as component
from scriptcontext import sticky as st


class InverseKinematics(component):
    def RunScript(self, robot, plane, start_configuration, group, compute):
        key = "inverse_solution"
        configuration = None
        if robot and robot.client and robot.client.is_connected and plane and compute:
            frame = plane_to_compas_frame(plane)
            configuration = robot.inverse_kinematics(frame, start_configuration, group)
            st["inverse_solution"] = configuration
        configuration = st.get("inverse_solution", None)
        return configuration
# ---------- end inverse ----------

markers_in_bcf = Plane(orient_2.Geometry)

# ----
# RANSAC Global registration
toggle_3 = BooleanToggle(True)
py3_9 = Python3Script(source=measurements_source_2, target=reference_target_2, threshold=Slider(1.093, range=0..10), compute=toggle_3)  # -> out, source_out, target_out, source_at_target, plane_out, T_RANSAC
# ---------- py3_9: Python ----------
from compas.geometry import Transformation

import open3d as o3d
import Rhino.Geometry as rg

from compas.geometry import Point, Frame
from compas_rhino.conversions import point_to_rhino, frame_to_rhino_plane

from mobile_robot_control.pointcloud_processing.ransac import preprocess_point_cloud_global, execute_global_registration2

if compute: 
    source, source_fpfh = preprocess_point_cloud_global(source, threshold)
    target, target_fpfh = preprocess_point_cloud_global(target, threshold)

    result_ransac = execute_global_registration2(source, target,
                                                source_fpfh, target_fpfh,
                                                threshold)
    print(result_ransac)

    T_RANSAC = Transformation.from_matrix(list(result_ransac.transformation))
    print(T_RANSAC)
    source_out = [rg.Point3d(*pt) for pt in source.points]
    target_out = [rg.Point3d(*pt) for pt in target.points]
    source_at_target = [point_to_rhino(Point(*pt).transformed(T_RANSAC)) for pt in source.points]
    frame_out = Frame.worldXY().transformed(T_RANSAC)
    plane_out = frame_to_rhino_plane(frame_out)
# ---------- end py3_9 ----------
panel_17 = Panel(py3_9.out)
number_slider_6 = Slider(0.1, range=0..0.1)
dots_2 = DotDisplay(Point=py3_9.source_out, Colour=ColourSwatch(SwatchColor=RGB(0, 204, 255)), Size=number_slider_6)
dots_3 = DotDisplay(Point=py3_9.target_out, Colour=ColourSwatch(SwatchColor=RGB(255, 0, 0)), Size=number_slider_6)

# ----
# Base Map Visualization
toggle_4 = BooleanToggle(True)
py3_10 = Python3Script(base_map=py3_8.base_map, apply_segment_penalty=toggle_4, apply_collision_penalty=Toggle(False), show=Toggle(True))  # -> out, planes, reuleaux_indices
# ---------- py3_10: Python ----------
import rhinoscriptsyntax as rs
from compas_ghpython.drawing import draw_frame
from statistics import mean
import math

planes = []
reuleaux_indices = []
if show:
    for node, data in base_map.base_map.nodes(data=True):
        # print(node)
        planes.append(draw_frame(data['frame']))
        reuleaux_data = data['reuleaux_data']
        if apply_segment_penalty and apply_collision_penalty:
            sum_penalties = data["penalty_factor"] + data["collision_penalty_factor"]
            if data["penalty_factor"] + data["collision_penalty_factor"] > 1:
                sum_penalties = 1.0
            ri_mean = data["mean_reuleaux_index"] * (1- sum_penalties)
        elif apply_segment_penalty:
            ri_mean = data["mean_reuleaux_index"] * (1- data["penalty_factor"])
        elif apply_collision_penalty:
            ri_mean = data["mean_reuleaux_index"] * (1- data["collision_penalty_factor"])
        else:
            ri_mean = data['mean_reuleaux_index']
        reuleaux_indices.append(ri_mean)
# ---------- end py3_10 ----------
bnd = Bounds(Numbers=py3_10.reuleaux_indices)
dedomain = DeconstructDomain(Domain=bnd)  # -> Start, End
gradient_2 = Gradient(
    LowerLimit=dedomain.Start,
    UpperLimit=dedomain.End,
    Parameter=py3_10.reuleaux_indices,
    stops=[0.001: RGB(0, 0, 0), 0.276: RGB(254, 244, 84), 0.75: RGB(173, 203, 249), 1: RGB(75, 107, 169)])
dots_4 = DotDisplay(Point=py3_10.planes, Colour=gradient_2, Size=expr("x/10", Slider(0.4, range=0..1)))

pln_3 = Plane(analytic_inverse.plane_RCF)
dots_5 = DotDisplay(Point=py3_9.source_at_target, Colour=ColourSwatch(SwatchColor=RGB(255, 144, 0)), Size=number_slider_6)
show_rcf = BooleanToggle(True)
show_robot_collision = BooleanToggle(False)
pln_4 = Plane(Plane(origin=(1.005773898, 2.594865348, 0), x=(0, 1, 0), y=(-1, 0, 0)))

# ----
# ICP
toggle_5 = BooleanToggle(True)
py3_11 = Python3Script(
    source=measurements_source_2,
    target=reference_target_2,
    initial_guess=pln_4,
    threshold=Slider(0.1, range=0..1),
    compute=toggle_5)  # -> out, source_out, target_out, source_at_target, plane_out, T_ICP
# ---------- py3_11: Python ----------
from compas.geometry import Point, Frame, Transformation
from compas_rhino.conversions import point_to_rhino, frame_to_rhino_plane
import Rhino.Geometry as rg

from mobile_robot_control.pointcloud_processing.icp import preprocess_point_cloud_icp, evaluate_local_registration, execute_icp_local_registration

# source_down = preprocess_point_cloud_icp(source, voxel_size)
# target_down = preprocess_point_cloud_icp(target, voxel_size)

trans_init, evaluation = evaluate_local_registration(source, target, threshold, initial_guess)
print(evaluation)

if compute:
    registration_icp = execute_icp_local_registration(source, target, threshold, trans_init)

    print("Inlier Fitness: ", registration_icp.fitness)
    print("Inlier RMSE: ", registration_icp.inlier_rmse)

    print("Transformation: \n", registration_icp.transformation)

source_out = [rg.Point3d(*pt) for pt in source.points]
target_out = [rg.Point3d(*pt) for pt in target.points]
T_ICP = Transformation.from_matrix(list(registration_icp.transformation))
source_at_target = [point_to_rhino(Point(*pt).transformed(T_ICP)) for pt in source.points]
frame_out = Frame.worldXY().transformed(T_ICP)
plane_out = frame_to_rhino_plane(frame_out)
# ---------- end py3_11 ----------
panel_18 = Panel(py3_11.out)

number_slider_7 = Slider(0.1, range=0..0.1)
dots_6 = DotDisplay(Point=py3_11.source_out, Colour=ColourSwatch(SwatchColor=RGB(0, 204, 255)), Size=number_slider_7)
dots_7 = DotDisplay(Point=py3_11.target_out, Colour=ColourSwatch(SwatchColor=RGB(255, 0, 0)), Size=number_slider_7)
dots_8 = DotDisplay(Point=py3_11.source_at_target, Colour=ColourSwatch(SwatchColor=RGB(255, 144, 0)), Size=number_slider_7)

# ----
# Robot plane
pln_5 = Plane(py3_11.plane_out)

# ----
# Move mobile robot base
list_8 = ValueList({"origin", "set_to_BCF", "set_to_RCF"}, selected="origin")
origin = Point(Point(1, -1, 0))
angle = Slider(0, range=0..360)
plane_2 = Python3Script(origin=origin, angle=angle)  # -> plane; inputs origin: Point3d
# ---------- plane_2: Python ----------
import Rhino.Geometry as rg
import math

plane = rg.Plane(origin, rg.Vector3d.XAxis, rg.Vector3d.YAxis)
plane.Rotate(math.radians(angle), rg.Vector3d.ZAxis)
# ---------- end plane_2 ----------
set_frame = Python3Script(robot=robot, set_frame_to=list_8, target_BCF=pln_5, target_RCF=plane_2)  # -> bang; inputs target_BCF: Plane, target_RCF: Plane
# ---------- set_frame: Python ----------
from compas_ghpython.drawing import draw_frame
from compas.geometry import Frame, Point, Vector, Transformation
from compas.datastructures import Mesh
from compas_fab.robots import CollisionMesh
from compas_rhino.conversions import plane_to_compas_frame

if set_frame_to == "set_to_BCF":
    BCF = plane_to_compas_frame(target_BCF)
elif set_frame_to == "set_to_RCF":
    RCF = plane_to_compas_frame(target_RCF)
    BCF = robot.transform_frame_from_RCF_to_BCF(RCF)
else:
    BCF = Frame.worldXY()

if robot:
    robot.BCF = BCF
# ---------- end set_frame ----------

sort = SortList(Keys=py3_10.reuleaux_indices, ValuesA=py3_10.planes)  # -> Keys, ValuesA
item_2 = ListItem(List=sort.ValuesA, Index=0, Wrap=True)  # -> Item1, Item
ideal_pose = Plane(item_2.Item1)

manual = Slider(20, range=0..100)
list_9 = ValueList({"Manual input": 0, "Ideal pose": 1}, selected="Manual input")
cp_2 = ClosestPoint(Point=ideal_pose, Cloud=pl_2)  # -> ClosestPoint, CPIndex, Distance
filter = StreamFilter(Gate=list_9, Stream0=manual, Stream1=cp_2.CPIndex)
py3_12 = Python3Script(base_map=py3_8.base_map, reachabilitymap=visualize_map.reachabilitymap, idx=filter, show=Toggle(True))  # -> out, base_plane, reuleaux_points, reuleaux_data, reuleaux_index, reachability_indices, points, values
# ---------- py3_12: Python ----------
__author__ = "Gido"
__version__ = "2023.09.12"

import rhinoscriptsyntax as rs
from compas_ghpython.drawing import draw_frame, draw_points

planes = []
reuleaux_indices = []
if show:
    i = 0
    for node, data in base_map.base_map.nodes(data=True):
        if i == idx:
            base_plane = draw_frame(data['frame'])
            reuleaux_index = data['mean_reuleaux_index']
            reuleaux_data = data['reuleaux_data']
            reuleaux_points = draw_points([{'pos': [pt.x, pt.y, pt.z]} for pt in reuleaux_data['reuleaux_points']])
            reachability_indices = [ri for point, ri in reachabilitymap.spheres_data(yield_ri=True)]
            points = draw_points([{'pos': [pt.x, pt.y, pt.z]} for pt in reuleaux_data['goal_points']])
            values = reuleaux_data['goal_reuleaux_index']
            break
        i += 1
# ---------- end py3_12 ----------
base_pose = Plane(py3_12.base_plane)

# ---- group: Reachability of evaluated goal_points
bnd_2 = Bounds(Numbers=py3_12.values)
dedomain_2 = DeconstructDomain(Domain=bnd_2)  # -> Start, End
gradient_3 = Gradient(
    LowerLimit=0,
    UpperLimit=dedomain_2.End,
    Parameter=py3_12.values,
    stops=[0.001: RGB(0, 0, 0), 0.276: RGB(254, 244, 84), 0.75: RGB(173, 203, 249), 1: RGB(75, 107, 169)])
dots_9 = DotDisplay(Point=py3_12.points, Colour=gradient_3, Size=expr("x/10", Slider(0.8, range=0..1)))

# ----
# Attach tool
list_10 = ValueList({"measurement tool": 0, "gripper": 1}, selected="gripper")
show_2 = BooleanToggle(True)
path_3 = Python3Script()  # -> DATA
# ---------- path_3: Python ----------
import os

package_path = ghdoc.Path
DATA = os.path.abspath(os.path.join(package_path,"../../data"))

print(package_path)
print(DATA)
# ---------- end path_3 ----------
remove = Button()
attach = Button()

tool = Python3Script(data_path=path_3, tool=list_10, multitool=multitool, show=show_2)  # -> tool, M, ee_plane, camera_plane; inputs data_path: String
# ---------- tool: Python ----------
import os, math
from compas.geometry import Frame, Rotation, Vector
from compas.datastructures import Mesh
from compas_rhino.conversions import mesh_to_rhino, frame_to_rhino_plane
from compas_fab.robots import Tool
from mobile_robot_control.multitool import MultiTool

tolerance = 0

if tool == 0:
    filename = 'measurement_toolx3.stl'
    ee_frame = Frame([0, 0, 0.109], [1, 0, 0], [0, 1, 0])

elif tool == 1:
    filename = 'gripper-basic.stl'
    ee_frame = Frame([0, -0.06185557, 0.37374513], [0, 1, 0], [-1, 0, 0])
    camera_frame = Frame([0.0175, -0.166, 0.163], [-1,0,0], [0,-1,0])
    tool_frames = {"gripper": ee_frame, "camera": camera_frame}


data_path = os.path.join(data_path, "tool_geometry")
fullfilename = os.path.join(data_path, filename)

ee_mesh = Mesh.from_stl(fullfilename)

if show:
    M = mesh_to_rhino(ee_mesh)

if multitool:
    tool = MultiTool(ee_mesh, tool_frames, primary_tool_name="gripper")
else:
    tool = Tool(ee_mesh, ee_frame)

ee_plane = frame_to_rhino_plane(ee_frame)
# print(ee_frame.quaternion.xyzw)
if camera_frame:
    camera_plane = frame_to_rhino_plane(camera_frame)
# ee_framek = Frame([0.0110607,0.00809854,0.41498], [0,1,0], [1,0,0])
# print(ee_framek.quaternion.xyzw)
# ---------- end tool ----------

attach_tool = Python3Script(robot=robot, tool=tool.tool, tool_name=list_6, attach=attach, update=update, remove=remove)  # -> tool, M, ee_plane, bang
# ---------- attach_tool: Python ----------
print(robot.get_group_names_from_link_name("robot_arm_flange"))

if attach:
    for planning_group in robot.get_group_names_from_link_name("robot_arm_flange"):
        robot.attach_tool(tool, group=planning_group)
if remove:
    for planning_group in robot.get_group_names_from_link_name("robot_arm_flange"):
        robot.detach_tool(group=planning_group)
if update:
    robot.attached_tool.set_active_tool_frame(tool_name)
# ---------- end attach_tool ----------
mesh = Mesh(tool.M)

# ----
# Visualisation
list_11 = ValueList({"0 zero_configuration": 0, "1 forward_kinematics": 1, "2 analytic_inverse_kinematics": 2, "3 inverse_kinematics": 3, "4 motion_planning": 4, "5 real_configuration": 5}, selected="2 analytic_inverse_kinematics")
filter_2 = StreamFilter(
    Gate=list_11,
    Stream0=zero.configuration,
    Stream1=forward_kinematics,
    Stream2=analytic_inverse.configuration,
    Stream3=inverse.configuration,
    Stream5=draw)
show_eef = BooleanToggle(True)
show_frames = BooleanToggle(True)
show_visual = BooleanToggle(True)
show_collision = BooleanToggle(True)
show_attached_collision = BooleanToggle(True)
show_bcf = BooleanToggle(True)
visualise = Python3Script(
    robot=robot,
    configuration=filter_2,
    show_frames=show_frames,
    show_visual_meshes=show_visual,
    show_robot_collision_meshes=show_robot_collision,
    show_collision_meshes=show_collision,
    show_attached_collision_meshes=show_attached_collision,
    show_BCF=show_bcf,
    show_RCF=show_rcf,
    show_EEF=show_eef,
    bang=[set_frame, attach_tool.bang])  # -> out, joint_planes, visual_meshes, robot_collision_meshes, collision_meshes, attached_meshes, BCF, RCF, EEF; inputs bang: list
# ---------- visualise: Python ----------
from scriptcontext import sticky as st
import time
from compas_ghpython import create_id
from compas.geometry import Frame
from compas.geometry import Transformation
from compas_rhino.conversions import frame_to_rhino, mesh_to_compas, mesh_to_rhino, frame_to_rhino_plane
from compas.scene import SceneObject
from compas_fab.robots import PlanningScene
import Rhino.Geometry as rg
import ghpythonlib.components as ghcomp

robot.update(configuration)

if show_frames == True: 
    #print(configuration)
    joint_frames = robot.model.transformed_frames(configuration)
    joint_planes = [frame_to_rhino(a) for a in joint_frames]

if show_BCF:
    BCF = frame_to_rhino(robot.BCF)

if show_RCF:
    print(robot.RCF)
    RCF = frame_to_rhino(robot.from_BCF_to_WCF(robot.RCF))

if show_EEF:
    EEF = frame_to_rhino(robot.from_BCF_to_WCF(robot.forward_kinematics(
        configuration, options=dict(solver="model")
        )))

if show_visual_meshes == True:
    visual_meshes = robot.draw_visual()
    # orient the robot to its base plane:
    robot_BCF = frame_to_rhino_plane(robot.BCF) 
    print(type(robot_BCF))
    init_robot_plane = rg.Plane.WorldXY
    #visual_meshes = ghcomp.Orient(visual_meshes, init_robot_plane, robot_BCF)[0]

if show_robot_collision_meshes == True:
    robot_collision_meshes = robot.draw_collision()

cached_scene_key = "cached_scene"

if show_collision_meshes or show_attached_collision_meshes:
    cached_scene = st.get(cached_scene_key)
    if not cached_scene:
        cached_scene = {"time": 0}

    # # expire cache if the component has not been executed in the last 2 seconds
    # # this allows to slide through a list of configurations
    # # without triggering refreshes of the scene in the middle of it

    # if time.time() - cached_scene["time"] > 2:
    #     update_scene = True
    # else:
    #     update_scene = False

    update_scene = True

    if update_scene:
        scene = PlanningScene(robot)
        scene = robot.client.get_planning_scene()

    if update_scene and show_collision_meshes:
        collision_meshes = []

        for co in scene.world.collision_objects:
            print(co)
            header = co.header
            frame_id = header.frame_id
            cms = co.to_collision_meshes()

            for cm in cms:
                if cm.frame != Frame.worldXY():
                    t = Transformation.from_frame(cm.frame)
                    mesh = cm.mesh.transformed(t)
                else:
                    mesh = cm.mesh
                collision_meshes.extend(SceneObject(item=mesh).draw())

        cached_scene["cm"] = collision_meshes

        collision_meshes = cached_scene.get("cm", [])

    if update_scene and show_attached_collision_meshes:
        attached_meshes = []

        for aco in scene.robot_state.attached_collision_objects:
            for acm in aco.to_attached_collision_meshes():
                frame_id = aco.object["header"]["frame_id"]
                frame = robot.forward_kinematics(configuration, options=dict(link=frame_id))
                t = Transformation.from_frame(frame)

                # Local CM frame
                if acm.collision_mesh.frame and acm.collision_mesh.frame != Frame.worldXY():
                    t = t * Transformation.from_frame(acm.collision_mesh.frame)

                mesh = acm.collision_mesh.mesh.transformed(t)

                attached_meshes.extend(SceneObject(item=mesh).draw())

        cached_scene["acm"] = attached_meshes

        attached_meshes = cached_scene.get("acm", [])
    
    cached_scene["time"] = time.time()
    st[cached_scene_key] = cached_scene
# ---------- end visualise ----------
py3_13 = Python3Script(planes=[visualise.BCF, visualise.RCF, visualise.EEF], scale=Slider(0.2, range=0..1))  # -> P, V, C, W; inputs planes: list of Plane, scale: Double
# ---------- py3_13: Python ----------
from Rhino.Display import ColorRGBA
from ghpythonlib.components import ColourRGBf


red = ColourRGBf(255, 255, 0, 0)
green = ColourRGBf(255, 0, 255, 0)
blue = ColourRGBf(255, 0, 0, 255)

P = []
V = []
C = []

# scale = float(scale)

for plane in planes:
    if not plane:
        continue
    P += [plane.Origin] * 3
    V.append(plane.XAxis * scale)
    V.append(plane.YAxis * scale)
    V.append(plane.ZAxis * scale)
    C += [red, green, blue]

W = 3
# ---------- end py3_13 ----------
pln_6 = Plane(visualise.joint_planes)
mesh_2 = Mesh(visualise.visual_meshes)
mesh_3 = Mesh(visualise.collision_meshes)
orient_3 = Orient(Geometry=visualise.visual_meshes, Source=PlaneXY(0, 0, 0), Target=visualise.BCF)  # -> Geometry, Transform
vdisex = VectorDisplayEx(Point=py3_13.P, Vector=py3_13.V, Colour=py3_13.C, Width=py3_13.W)
preview_4 = CustomPreview(Geometry=orient_3.Geometry, Material=ColourSwatch(SwatchColor=RGB(74, 74, 74)))

mesh_4 = Mesh(visualise.robot_collision_meshes)
mesh_5 = Mesh(visualise.attached_meshes)
