# Grasshopper definition 05_robot_moveit_planning_and_control.ghx (Grasshopper 1.0.8)

# ----
# Design from curve
number_slider = Slider(0.35, range=0..1)
crv = Curve(<curve referenced from the Rhino model>)
division = Division(A=number_slider, B="2")
divlength = DivideLength(Curve=crv, Length=division)  # -> Points, Tangents, Parameters

# ----
# Create a part
toggle = BooleanToggle(True)
part = Python3Script()  # -> out, part
# ---------- part: Python ----------
from compas.geometry import Frame, Vector, Box
from compas.geometry import Transformation, Translation
# from assembly_information_model import Part

from qut_assembly import MarkedPart

# dimensions
width = 0.07
length = 0.30
height = 0.035

# create parte
center_frame = Frame([0., 0., 0.], [0, -1, 0], [1, 0, 0]) #center of the box frame 
part_geometry = Box(width, length, height, center_frame, 'box')

    #create pick plane for gripper
offset = Vector (0,width/2,0)
pick_plane = Frame(center_frame.point + offset, center_frame.xaxis, center_frame.yaxis)


part = MarkedPart.from_shape(part_geometry, name="Part", frame=pick_plane)
part.height = height

marker_offset_x = 0.010
marker_offset_y = -0.005
marker_offset_z = 0
Tvec = Vector(marker_offset_x, marker_offset_y, marker_offset_z)
part.marker_frame = center_frame.transformed(Translation.from_vector(Tvec))
# ---------- end part ----------
show = Python3Script(my_part=part.part, show=toggle)  # -> out, plane, mesh
# ---------- show: Python ----------
from compas_rhino.conversions import mesh_to_rhino, box_to_rhino, frame_to_rhino


if show:

    #extract the mesh of the part for visulization
    compas_mesh = my_part.mesh
    #convert to rhino mesh
    mesh = mesh_to_rhino(compas_mesh)
    
    #extract the frame of the part for visulization
    frame = my_part.frame
    #convert to rhino plane
    plane = frame_to_rhino(frame)
# ---------- end show ----------
pln = Plane(show.plane)
geo = Geometry(show.mesh)

# ----
# Unload Python modules
button = Button()
unload = Python3Script(unload=button)  # -> out, a
# ---------- unload: Python ----------
from compas_rhino import unload_modules

unload_modules('assembly_information_model')
unload_modules('assembly_information_model.assembly')
unload_modules('assembly_information_model.part')
unload_modules('qut_assembly')
# ---------- end unload ----------

Z = UnitZ(Factor=1)
xprod = CrossProduct(VectorA=divlength.Tangents, VectorB=Z, Unitize=False)  # -> Vector, Length
pl = ConstructPlane(Origin=divlength.Points, XAxis=divlength.Tangents, YAxis=xprod.Vector)

# ----
# Transform part
merge = Merge()
create_parts = Python3Script(part=part.part, planes=pl)  # -> out, parts; inputs planes: list of Plane
# ---------- create_parts: Python ----------
from compas.geometry import Frame, Transformation
from compas_rhino.conversions import plane_to_compas_frame

frames = [plane_to_compas_frame(plane) for plane in planes]
print(frames)
parts = []
for frame in frames:
    T = Transformation.from_frame_to_frame(Frame.worldXY(), frame)
    parts.append(part.transformed(T))
# ---------- end create_parts ----------

# ----
# Create the assembly
toggle_2 = BooleanToggle(True)
assembly = Python3Script(create=toggle_2, parts=create_parts.parts)  # -> out, assembly; inputs parts: list
# ---------- assembly: Python ----------
import math

from compas.geometry import Frame, Point
from compas.geometry import Transformation, Rotation, Translation
from compas_rhino.conversions import plane_to_compas_frame

from assembly_information_model.assembly import Assembly

if create:
    #create empty assembly
    assembly = Assembly()

    for part in parts:
        assembly.add_part(part)
# ---------- end assembly ----------

cp = Plane(PlaneXY(0.4, 0.4, 0))
cp_new = Plane(PlaneXY(0.8, 0.4, 0))
transform = Python3Script(assembly=assembly.assembly, transform=Toggle(False), center_plane=cp, center_plane_new=cp_new)  # -> out, assembly
# ---------- transform: Python ----------
from compas.geometry import Frame, Transformation, Rotation, Translation
from compas_rhino.conversions import plane_to_compas_frame

center_frame = plane_to_compas_frame(center_plane)
center_frame_new = plane_to_compas_frame(center_plane_new)


if transform:
    T = Transformation.from_frame_to_frame(center_frame, center_frame_new)
    assembly = assembly.transformed(T)
# ---------- end transform ----------

Z_2 = UnitZ(Factor=Slider(0.035, range=0..0.1))
sift = SiftPattern(List=pl, SiftPattern=[0, 1])  # -> Output0, Output1
move = Move(Geometry=sift.Output1, Motion=Z_2)  # -> Geometry, Transform
weave = Weave(Pattern=[0, 1], Stream0=sift.Output0, Stream1=move.Geometry, NullGaps=False)
pln_2 = Plane(weave)
entwine = Entwine(Branch00=sift.Output0, Branch01=move.Geometry, FlattenInputs=True)

reset = Button()
back = Button()
start = Button()
stop = Button()
step = Button()
full = Button()
list = ValueList({"20", "50", "100", "500", "1000", "5000"}, selected="500")
counter = Python3Script(assembly=transform.assembly, start=start, stop=stop, step=step, step_back=back, reset=reset, full=full, interval=list)  # -> out, counter
# ---------- counter: Python ----------
from scriptcontext import sticky as st
import Grasshopper

def update_component(ghenv, delay):
    """Schedule an update of the Grasshopper component.

    After the specified delay, the GH component will be automatically updated.

    Parameters
    ----------
    ghenv : :class:`GhPython.Component.PythonEnvironment`
        The current GHPython environment.
    delay : :obj:`int`
        Time in milliseconds until the update is performed.

    Raises
    ------
    ValueError
        If the delay is less than zero.

    """
    if delay <= 0:
        raise ValueError("Delay must be greater than zero")

    ghcomp = ghenv.Component
    ghdoc = ghcomp.OnPingDocument()

    def callback(ghdoc):
        if ghdoc.SolutionState != Grasshopper.Kernel.GH_ProcessStep.Process:
            ghcomp.ExpireSolution(False)

    ghdoc.ScheduleSolution(delay, Grasshopper.Kernel.GH_Document.GH_ScheduleDelegate(callback))

L = range(assembly.graph.number_of_nodes())

# store data in component
guid = str(ghenv.Component.InstanceGuid)
counter_key = "counter_" + guid
running_key = "running_" + guid

if counter_key not in st:
    st[counter_key] = 0

if running_key not in st:
    st[running_key] = False
    

if st[running_key]:
    if st[counter_key] < len(L) - 1:
        st[counter_key] += 1
        update_component(ghenv, interval)
    else:
        st[counter_key] = 0
        st[running_key] = False
    
if start:
    st[running_key] = True

if stop:
    st[running_key] = False

if step:
    if st[counter_key] < len(L) - 1:
        st[counter_key] += 1

if step_back:
    if st[counter_key] < len(L) - 1:
        st[counter_key] -= 1

if reset:
    st[counter_key] = 0
    st[running_key] = False

if full:
    st[counter_key] = len(L)-1

if len(L):
    item = L[st[counter_key]]


#st["visualisation_counter"] = st[counter_key]
counter = st[counter_key]+1
# ---------- end counter ----------
panel = Panel(counter.counter)

# ----
# Draw
list_2 = ValueList({"show all": "show_all", "show until key": "show_until_key"}, selected="show until key")
visualize = Python3Script(assembly=transform.assembly, show=list_2, highlight_current_part=Toggle(True), counter=counter.counter)  # -> out, parts_geometry, parts_frame, current_part_geometry, current_part_frame
# ---------- visualize: Python ----------
from compas_rhino.conversions import mesh_to_rhino, box_to_rhino, frame_to_rhino

#print assembly
print(assembly)

#get parts datastructure
parts = [p for p in assembly.parts()]

#get current part



if show == "show_all":
    
    #extract the mesh of the parts for visulization (+ converted to rhino mesh)
    parts_geometry = [mesh_to_rhino(p.mesh) for p in parts]
    
    #extract the frame of the parts for visulization (+ converted to rhino plane)
    parts_frame = [frame_to_rhino(p.frame) for p in parts]

    key = assembly.graph.number_of_nodes()-1

if show == "show_until_key":
    #extract the mesh of the parts for visulization (+ converted to rhino mesh)
    parts_geometry = [mesh_to_rhino(p.mesh) for p in parts[0:counter]]
    
    #extract the frame of the parts for visulization (+ converted to rhino plane)
    parts_frame = [frame_to_rhino(p.frame) for p in parts[0:counter]]

    key = counter-1

if highlight_current_part:
    current_part = assembly.part(key)
    current_part_geometry = mesh_to_rhino(current_part.attributes["mesh"])
    current_part_frame = frame_to_rhino(current_part.frame)
# ---------- end visualize ----------
panel_2 = Panel(visualize.out)
geo_2 = Geometry([visualize.current_part_geometry, visualize.current_part_frame])
geo_3 = Geometry(visualize.parts_frame)
geo_4 = Geometry(visualize.parts_geometry)
preview = CustomPreview(Geometry=geo_3, Material=ColourSwatch(SwatchColor=RGB(255, 125, 157)))
preview_2 = CustomPreview(Geometry=geo_4, Material=ColourSwatch(SwatchColor=RGBA(255, 227, 227, 233)))
preview_3 = CustomPreview(Geometry=geo_2, Material=ColourSwatch(SwatchColor=RGB(255, 125, 157)))

# ----
# Update robot base location
base_plane = Plane(Plane(origin=(1.276877991, 1.759565459, 0), x=(-0.4144677566, 0.9100639971, 0), y=(-0.9100639971, -0.4144677566, 0)))

# ----
# Pickup target
number_slider_2 = Slider(0.08, range=-0.1..0.1)
pln_3 = Plane(Plane(origin=(-0.3856961778, 0, 0.8023931501), x=(-1, 0, 0), y=(0, 1, 0)))
vec = VectorXYZ(XComponent=number_slider_2, YComponent=Slider(0, range=-0.1..0.1), ZComponent=Slider(-0.15, range=-0.2..0.2))  # -> Vector, Length
move_2 = Move(Geometry=pln_3, Motion=vec.Vector)  # -> Geometry, Transform
orient = Orient(Geometry=move_2.Geometry, Source=PlaneXY(0, 0, 0), Target=base_plane)  # -> Geometry, Transform

# ----
# Create Pick-Safe-Plane
number_slider_3 = Slider(0.4, range=0..1)
Z_3 = UnitZ(Factor=number_slider_3)
move_3 = Move(Geometry=move_2.Geometry, Motion=Z_3)  # -> Geometry, Transform

# ----
# Update tool target
tool_plane = Plane(visualize.current_part_frame)

# ----
# Create Tool-Safe-Plane
number_slider_4 = Slider(0.4, range=0..1)
Z_4 = UnitZ(Factor=number_slider_4)
move_4 = Move(Geometry=tool_plane, Motion=Z_4)  # -> Geometry, Transform

orient_2 = Orient(Geometry=move_4.Geometry, Source=base_plane, Target=PlaneXY(0, 0, 0))  # -> Geometry, Transform
orient_3 = Orient(Geometry=move_3.Geometry, Source=PlaneXY(0, 0, 0), Target=base_plane)  # -> Geometry, Transform
orient_4 = Orient(Geometry=tool_plane, Source=base_plane, Target=PlaneXY(0, 0, 0))  # -> Geometry, Transform
pln_4 = Plane(orient_2.Geometry)

# ----
# ROS client
list_3 = ValueList({"local": "127.0.0.1", "linux computer": "192.168.0.42", "linux eduroam": "10.181.95.254", "linux ccnet": "192.168.0.102", "linux vmware": "192.168.199.36", "robot": "192.168.0.200", "robotAA_wifi": "192.168.0.111", "robotAB_wifi": "192.168.0.112", "robotAB_eduroam": "10.181.67.95"}, selected="local")
connect = BooleanToggle(True)
ros = Python3Script(ip=list_3, port="9090", connect=connect)  # -> out, ros_client, is_connected; inputs ip: String, port: Int32, connect: Boolean
# ---------- ros: Python ----------
"""
Connect or disconnect to ROS.

COMPAS FAB v0.27.0
"""
from scriptcontext import sticky as st

from compas_fab.backends import RosClient

ros_client = None

ip = ip or '127.0.0.1'
port = port or 9090
key = "ros_client_001"
ros_client = st.get(key, None)

if ros_client:
    st[key].close()
if connect:
    st[key] = RosClient(ip, port)
    st[key].run(5)

ros_client = st.get(key, None)
is_connected = ros_client.is_connected if ros_client else False
# ---------- end ros ----------
panel_3 = Panel(ros.is_connected)

# ----
# Load robot from ROS
load = Button()
# Make sure that ros bridge, file server, tf2_web_republisher and moveit config is running on the robot!
panel_4 = Panel("")
mobile_robot = Python3Script(ros_client=ros.ros_client, prefix=panel_4, load=load)  # -> out, mobile_robot; inputs prefix: String
# ---------- mobile_robot: Python ----------
"""
Load robot directly from ROS.

COMPAS FAB v0.27.0
"""
from mobile_robot_control.mobile_robot import MobileRobot
from mobile_robot_control.mobile_robot_client import MobileRobotClient
import compas_robots.ghpython

# from ghpythonlib.componentbase import executingcomponent as component
from scriptcontext import sticky as st
import Rhino
import scriptcontext

scriptcontext.doc = Rhino.RhinoDoc.ActiveDoc

from compas_robots import RobotModel
from compas.scene import SceneObject
# from compas_robots.ghpython.scene import RobotModelObject

scriptcontext.doc = ghdoc

key = 'robot_AA'
print(key)
if ros_client and ros_client.is_connected and load:
    # Load URDF from ROS
    robot = ros_client.load_robot(
            load_geometry=True, 
            urdf_param_name= '{}/robot_description'.format(prefix),
            srdf_param_name= '{}/robot_description_semantic'.format(prefix))
    robot.scene_object = SceneObject(item=robot.model)
    mobile_robot = MobileRobot(robot.model, robot.scene_object, robot.semantics, client=None)
    st[key] = mobile_robot

mobile_robot = st.get(key, None)
if mobile_robot:  # client sometimes need to be restarted, without needing to reload geometry
    mobile_robot.mobile_client = MobileRobotClient(ros_client)
    mobile_robot.client = ros_client
# ---------- end mobile_robot ----------

reload = Button()
# ROBOT
py3 = Python3Script()  # -> HERE, DATA, ROBOT_DESCRIPTION
# ---------- py3: Python ----------
import os

HERE = os.path.dirname(ghdoc.Path)
DATA = os.path.abspath(os.path.join(HERE, "..", "data"))
ROBOT_DESCRIPTION = os.path.abspath(os.path.join(DATA, "robot_description"))

print(HERE)
print(DATA)
print(ROBOT_DESCRIPTION)
# ---------- end py3 ----------
reload_2 = Python3Script(reload=reload)  # -> out
# ---------- reload_2: Python ----------
if reload:
    from compas_rhino import unload_modules
    unload_modules("assembly_information_model")
    unload_modules('ur_fabrication_control')
# ---------- end reload_2 ----------

robot = Data(mobile_robot.mobile_robot)
info = Python3Script(robot=robot)  # -> out, main_group_name
# ---------- info: Python ----------
if robot:
    robot.info()
    main_group_name = robot.main_group_name
# ---------- end info ----------
panel_5 = Panel(info.out)

# ----
# Move mobile robot base
list_4 = ValueList({"origin", "set_to_BCF", "set_to_RCF"}, selected="set_to_BCF")
origin = Point(Point(1, -1, 0))
angle = Slider(0, range=0..360)
plane = Python3Script(origin=origin, angle=angle)  # -> plane; inputs origin: Point3d
# ---------- plane: Python ----------
import Rhino.Geometry as rg
import math

plane = rg.Plane(origin, rg.Vector3d.XAxis, rg.Vector3d.YAxis)
plane.Rotate(math.radians(angle), rg.Vector3d.ZAxis)
# ---------- end plane ----------
set_frame = Python3Script(robot=robot, set_frame_to=list_4, target_BCF=base_plane, target_RCF=plane)  # -> bang; inputs target_BCF: Plane, target_RCF: Plane
# ---------- set_frame: Python ----------
from compas_ghpython.drawing import draw_frame
from compas.geometry import Frame, Point, Vector, Transformation
from compas.datastructures import Mesh
from compas_fab.robots import CollisionMesh
from compas_rhino.conversions import plane_to_compas_frame

if set_frame_to == "set_to_BCF":
    BCF = plane_to_compas_frame(target_BCF)
elif set_frame_to == "set_to_RCF":
    RCF = plane_to_compas_frame(target_RCF)
    BCF = robot.transform_frame_from_RCF_to_BCF(RCF)
else:
    BCF = Frame.worldXY()

if robot:
    robot.BCF = BCF
# ---------- end set_frame ----------

# ----
# Attach tool
list_5 = ValueList({"measurement tool": 0, "gripper": 1}, selected="gripper")
show_2 = BooleanToggle(True)
path = Python3Script()  # -> DATA
# ---------- path: Python ----------
import os

package_path = ghdoc.Path
DATA = os.path.abspath(os.path.join(package_path,"../../data"))

print(package_path)
print(DATA)
# ---------- end path ----------
tool = Python3Script(data_path=path, tool=list_5, show=show_2)  # -> tool, M, ee_plane; inputs data_path: String
# ---------- tool: Python ----------
import os, math
from compas.geometry import Frame, Rotation, Vector
from compas.datastructures import Mesh
from compas_rhino.conversions import mesh_to_rhino, frame_to_rhino_plane
from compas_fab.robots import Tool

tolerance = 0

if tool == 0:
    filename = 'measurement_toolx3.stl'
    ee_frame = Frame([0, 0, 0.109], [1, 0, 0], [0, 1, 0])

elif tool == 1:
    filename = 'gripper-basic.stl'
    ee_frame = Frame([0, -0.06185557, 0.37374513], [0, 1, 0], [-1, 0, 0])

data_path = os.path.join(data_path, "tool_geometry")
fullfilename = os.path.join(data_path, filename)

ee_mesh = Mesh.from_stl(fullfilename)

if show:
    M = mesh_to_rhino(ee_mesh)

tool = Tool(ee_mesh, ee_frame)
ee_plane = frame_to_rhino_plane(ee_frame)
print(ee_frame.quaternion.xyzw)
ee_framek = Frame([0.0110607,0.00809854,0.41498], [0,1,0], [1,0,0])
print(ee_framek.quaternion.xyzw)
# ---------- end tool ----------
remove = Button()
attach = Button()
mesh = Mesh(tool.M)
attach_tool = Python3Script(robot=robot, tool=tool.tool, attach=attach, remove=remove)  # -> tool, M, ee_plane, bang
# ---------- attach_tool: Python ----------
print(robot.get_group_names_from_link_name("robot_arm_flange"))

if attach:
    for planning_group in robot.get_group_names_from_link_name("robot_arm_flange"):
        robot.attach_tool(tool, group=planning_group)
if remove:
    for planning_group in robot.get_group_names_from_link_name("robot_arm_flange"):
        robot.detach_tool(group=planning_group)
# ---------- end attach_tool ----------

pln_5 = Plane(tool.ee_plane)

# ----
# real robot values
subscribe = Button()
unsubscribe = Button()
get_joint_states = Python3Script(robot=robot, subscribe=subscribe, unsubscribe=unsubscribe)
# ---------- get_joint_states: Python ----------
if subscribe:
    robot.mobile_client.joint_states_subscribe()

if unsubscribe:
    robot.mobile_client.joint_states_unsubscribe()

#robot.mobile_client.tf_subscribe("robot_arm_base", "robot_base_footprint")
#print('x')
# ---------- end get_joint_states ----------
trigger = Trigger(Interval=2000, TimerInterval=2000, Target=draw)  # disabled
draw = Python3Script(robot=robot)  # -> configuration
# ---------- draw: Python ----------
from compas_robots import Configuration

configuration = robot.mobile_client.get_current_configuration()
print(configuration)
# ---------- end draw ----------

# ----
# Configuration
# zero configuration
zero = Python3Script(robot=robot, group=info.main_group_name)  # -> out, configuration; inputs group: String
# ---------- zero: Python ----------
configuration = robot.zero_configuration(group)
# ---------- end zero ----------

number_slider_5 = Slider(0.26, range=0..0.8)

# ----
# Pick-Safe-Plane configuration
# analytical inverse kinematics
select_configuration = Slider(1, range=0..7)
analytic_inverse = Python3Script(robot=robot, lift=number_slider_5, plane=orient_3.Geometry, idx=select_configuration)  # -> out, configuration, plane_RCF, plane_tool0_RCF; inputs plane: Plane, idx: Int32
# ---------- analytic_inverse: Python ----------
import Rhino.Geometry as rg
import math
from compas.geometry import Frame, Transformation, Rotation, Translation
from compas_robots import Configuration
from ur_fabrication_control.kinematics.ur_kinematics import inverse_kinematics
from ur_fabrication_control.kinematics.ur_params import ur_params
from compas_rhino.conversions import plane_to_compas_frame
from compas_ghpython.drawing import draw_frame

# transform frame to robot coordinate system
frame_WCF = plane_to_compas_frame(plane)
frame_BCF = robot.from_WCF_to_BCF(frame_WCF)
frame_RCF = robot.from_WCF_to_RCF(frame_BCF)
frame_RCF.transform(Translation.from_vector([0,0,-lift]))

if robot.attached_tool:
    tool0_RCF = robot.from_tcf_to_t0cf([frame_RCF])[0]
else:
    tool0_RCF = frame_RCF

plane_tool0_RCF = draw_frame(tool0_RCF)
plane_RCS = draw_frame(frame_RCF)
# print(plane_RCS)

# calculate solutions to frame
ur_params = ur_params["ur20"] # get the parameters according to the robot model
# print ur_params
solutions = inverse_kinematics(tool0_RCF, ur_params)
# print solutions

if not len(solutions):
    joint_values = [0, 0, 0, 0, 0, 0]
else:
    joint_values = solutions[idx]

if len(robot.get_configurable_joints()) == 6:
    configuration = Configuration.from_revolute_values(joint_values)
else:
    configuration = Configuration.from_prismatic_and_revolute_values([lift], joint_values)

print(configuration)
# ---------- end analytic_inverse ----------

# ----
# Plan motion in Joint-space
robot_2 = Data(robot)
group = Data("ur20")
constraints_from_plane = Python3Script(robot=robot_2, plane=pln_4, group=group)  # -> constraints
# ---------- constraints_from_plane: Python ----------
"""
Create a position and an orientation constraint from a plane calculated for the group's end-effector link.

COMPAS FAB v1.0.2
"""

import math

from compas_rhino.conversions import plane_to_compas_frame
from ghpythonlib.componentbase import executingcomponent as component


class ConstraintsFromPlane(component):
    def RunScript(self,
            robot,
            plane,
            group,
            tolerance_position,
            tolerance_xaxis,
            tolerance_yaxis,
            tolerance_zaxis):
        goal_constraints = None
        if robot and plane:
            tolerance_position = tolerance_position or 0.001
            tolerance_xaxis = tolerance_xaxis or 1.0
            tolerance_yaxis = tolerance_yaxis or 1.0
            tolerance_zaxis = tolerance_zaxis or 1.0

            frame = plane_to_compas_frame(plane)
            tolerances_axes = [
                math.radians(tolerance_xaxis),
                math.radians(tolerance_yaxis),
                math.radians(tolerance_zaxis),
            ]
            goal_constraints = robot.constraints_from_frame(frame, tolerance_position, tolerances_axes, group)

        return goal_constraints
# ---------- end constraints_from_plane ----------
compute = Button()
plan_motion = Python3Script(
    robot=robot_2,
    goal_constraints=constraints_from_plane,
    start_configuration=analytic_inverse.configuration,
    group=group,
    compute=compute)  # -> out, trajectory; inputs goal_constraints: list
# ---------- plan_motion: Python ----------
"""
Calculate a motion path.

COMPAS FAB v1.0.2
"""

from ghpythonlib.componentbase import executingcomponent as component
from scriptcontext import sticky as st
import System

# from compas_fab.ghpython.components import create_id


class PlanMotion(component):
    def RunScript(self,
            robot,
            goal_constraints: System.Collections.Generic.List[object],
            start_configuration,
            group,
            attached_collision_meshes,
            path_constraints,
            planner_id,
            compute):
        key = "trajectory"

        path_constraints = list(path_constraints) if path_constraints else None
        attached_collision_meshes = list(attached_collision_meshes) if attached_collision_meshes else None
        planner_id = str(planner_id) if planner_id else "RRTConnect"

        if (
            robot
            and robot.client
            and robot.client.is_connected
            and start_configuration
            and goal_constraints
            and compute
        ):
            st[key] = robot.plan_motion(
                goal_constraints,
                start_configuration=start_configuration,
                group=group,
                options=dict(
                    attached_collision_meshes=attached_collision_meshes,
                    path_constraints=path_constraints,
                    planner_id=planner_id,
                ),
            )

        trajectory = st.get(key, None)
        return trajectory
# ---------- end plan_motion ----------
trajectory_visualize = Python3Script(robot=robot_2, group=group, trajectory=plan_motion.trajectory)  # -> out, start_configuration, configurations, fraction, time, planes, P, V, A
# ---------- trajectory_visualize: Python ----------
"""
Visualizes a trajectory.

COMPAS FAB v1.0.2
"""

from compas_ghpython.drawing import draw_frame
from compas_ghpython.sets import list_to_ghtree
from ghpythonlib.componentbase import executingcomponent as component


class TrajectoryVisualize(component):
    def RunScript(self, robot, group, trajectory):
        start_configuration = None
        configurations = []
        fraction = 0.0
        time = 0.0

        planes = []
        positions = []
        velocities = []
        accelerations = []

        if robot and trajectory:
            group = group or robot.main_group_name

            for c in trajectory.points:
                configurations.append(
                    robot.merge_group_with_full_configuration(c, trajectory.start_configuration, group)
                )
                frame = robot.forward_kinematics(c, group, options=dict(solver="model"))
                planes.append(draw_frame(frame))
                positions.append(c.positions)
                velocities.append(c.velocities)
                accelerations.append(c.accelerations)

            start_configuration = trajectory.start_configuration
            fraction = trajectory.fraction
            time = trajectory.time_from_start

        P = list_to_ghtree(list(zip(*positions)))
        V = list_to_ghtree(list(zip(*velocities)))
        A = list_to_ghtree(list(zip(*accelerations)))
        print(configurations)
        # return outputs if you have them; here I try it for you:
        return (start_configuration, configurations, fraction, time, planes, P, V, A)
# ---------- end trajectory_visualize ----------
pln_6 = Python3Script(P=trajectory_visualize.planes)  # -> P
# ---------- pln_6: Python ----------
print("hi")
# ---------- end pln_6 ----------
pline = PolyLine(Vertices=pln_6, Closed=False)
select = Python3Script(L=trajectory_visualize.configurations, i=Slider(46, range=0..100))  # -> a; inputs i: Int32
# ---------- select: Python ----------
print(len(L))

if i < len(L):
    a = L[i]
else:
    a = L[-1]
# ---------- end select ----------
preview_4 = CustomPreview(Geometry=pline, Material=ColourSwatch(SwatchColor=RGB(59, 137, 161)))

# ----
# Pick-Plane configuration
# analytical inverse kinematics
select_configuration_2 = Slider(1, range=0..7)
analytic_inverse_2 = Python3Script(robot=robot, lift=number_slider_5, plane=orient.Geometry, idx=select_configuration_2)  # -> out, configuration, plane_RCF, plane_tool0_RCF; inputs plane: Plane, idx: Int32; same code as analytic_inverse

item = ListItem(List=trajectory_visualize.configurations, Index=0, Wrap=True)  # -> Item1, Item

# ----
# Tool-Plane configuration
# inverse kinematics
list_6 = ValueList({"ur20", "ur20_and_liftkit"}, selected="ur20")
compute_2 = Button()
inverse = Python3Script(robot=robot, plane=orient_4.Geometry, start_configuration=item.Item1, group=list_6, compute=Toggle(True))  # -> out, configuration
# ---------- inverse: Python ----------
"""
Calculate the robot's inverse kinematic for a given plane.

COMPAS FAB v1.0.2
"""

from compas_rhino.conversions import plane_to_compas_frame
from ghpythonlib.componentbase import executingcomponent as component
from scriptcontext import sticky as st


class InverseKinematics(component):
    def RunScript(self, robot, plane, start_configuration, group, compute):
        key = "inverse_solution"
        configuration = None
        if robot and robot.client and robot.client.is_connected and plane and compute:
            frame = plane_to_compas_frame(plane)
            configuration = robot.inverse_kinematics(frame, start_configuration, group)
            st["inverse_solution"] = configuration
        configuration = st.get("inverse_solution", None)
        return configuration
# ---------- end inverse ----------

# ----
# forward kinematics
number_slider_6 = Slider(18.8, range=-180..180)
forward_kinematics = Python3Script(
    robot=robot,
    lift=number_slider_5,
    j1=number_slider_6,
    j2=Slider(-137.4, range=-360..360),
    j3=Slider(-98, range=-180..180),
    j4=Slider(5, range=-400..400),
    j5=Slider(88, range=-125..120),
    j6=Slider(54, range=-400..400))  # -> configuration
# ---------- forward_kinematics: Python ----------
import math

from compas_robots.model import Joint
from compas_robots import Configuration


if robot:
    joint_types = robot.get_configurable_joint_types()
    joint_names = robot.get_configurable_joint_names()

    joint_values = [j1, j2, j3, j4, j5, j6]
    for i, joint_value in enumerate(joint_values):
        joint_values[i] = math.radians(joint_values[i])
    
    if len(robot.get_configurable_joints()) == 6:
        configuration = Configuration(joint_values, joint_types, joint_names)
    else:
        configuration = Configuration.from_prismatic_and_revolute_values([lift], joint_values)
    print (configuration)
# ---------- end forward_kinematics ----------

# ----
# analytical inverse kinematics
select_configuration_3 = Slider(1, range=0..7)
plane_2 = Plane(orient_3.Geometry)
analytic_inverse_3 = Python3Script(robot=robot, lift=number_slider_5, plane=plane_2, idx=select_configuration_3)  # -> out, configuration, plane_RCF, plane_tool0_RCF; inputs plane: Plane, idx: Int32; same code as analytic_inverse

# ----
# inverse kinematics
list_7 = ValueList({"ur20", "ur20_and_liftkit"}, selected="ur20_and_liftkit")
compute_3 = Button()
inverse_2 = Python3Script(robot=robot, plane=plane_2, group=list_7, compute=compute_3)  # -> out, configuration; same code as inverse

item_2 = ListItem(List=trajectory_visualize.configurations, Index=Slider(0, range=0..20), Wrap=True)
# Combine reversed planned motion + pick-plane configuration
rev = ReverseList(List=trajectory_visualize.configurations)

# ----
# Full path
rev_2 = ReverseList(List=trajectory_visualize.configurations)
entwine_2 = Entwine(
    Branch00=analytic_inverse_2.configuration,
    Branch01=trajectory_visualize.configurations,
    Branch02=inverse.configuration,
    Branch03=rev,
    FlattenInputs=True)
flatten = FlattenTree(Tree=entwine_2, Path="{0}")
# Combine planned motion + tool-safe-plane configuration
item_3 = ListItem(List=flatten, Index=Slider(0, range=0..100), Wrap=True)

entwine_3 = Entwine(Branch00=trajectory_visualize.configurations, Branch01=inverse.configuration, FlattenInputs=True)  # -> flatten(Result)
entwine_4 = Entwine(Branch00=rev, Branch01=analytic_inverse_2.configuration, FlattenInputs=True)  # -> flatten(Result)
pln_7 = Plane(analytic_inverse_3.plane_RCF)
show_rcf = BooleanToggle(True)
show_robot_collision = BooleanToggle(False)

# ----
# Visualisation
list_8 = ValueList({"0 zero_configuration": 0, "1 forward_kinematics": 1, "2 analytic_inverse_kinematics": 2, "3 inverse_kinematics": 3, "4 motion_planning": 4, "5 real_configuration": 5, "6 full_path": 6}, selected="6 full_path")
filter = StreamFilter(
    Gate=list_8,
    Stream0=zero.configuration,
    Stream1=forward_kinematics,
    Stream2=analytic_inverse_3.configuration,
    Stream3=inverse_2.configuration,
    Stream4=item_2,
    Stream5=draw,
    Stream6=item_3)
show_eef = BooleanToggle(True)
show_frames = BooleanToggle(True)
show_visual = BooleanToggle(True)
show_collision = BooleanToggle(True)
show_attached_collision = BooleanToggle(True)
show_bcf = BooleanToggle(True)
visualise = Python3Script(
    robot=robot,
    configuration=filter,
    show_frames=show_frames,
    show_visual_meshes=show_visual,
    show_robot_collision_meshes=show_robot_collision,
    show_collision_meshes=show_collision,
    show_attached_collision_meshes=show_attached_collision,
    show_BCF=show_bcf,
    show_RCF=show_rcf,
    show_EEF=show_eef,
    bang=[set_frame, attach_tool.bang])  # -> out, joint_planes, visual_meshes, robot_collision_meshes, collision_meshes, attached_meshes, BCF, RCF, EEF; inputs bang: list
# ---------- visualise: Python ----------
from scriptcontext import sticky as st
import time
from compas_ghpython import create_id
from compas.geometry import Frame
from compas.geometry import Transformation
from compas_rhino.conversions import frame_to_rhino, mesh_to_compas, mesh_to_rhino, frame_to_rhino_plane
from compas.scene import SceneObject
from compas_fab.robots import PlanningScene
import Rhino.Geometry as rg
import ghpythonlib.components as ghcomp

robot.update(configuration)

if show_frames == True: 
    #print(configuration)
    joint_frames = robot.model.transformed_frames(configuration)
    joint_planes = [frame_to_rhino(a) for a in joint_frames]

if show_BCF:
    BCF = frame_to_rhino(robot.BCF)

if show_RCF:
    print(robot.RCF)
    RCF = frame_to_rhino(robot.from_BCF_to_WCF(robot.RCF))

if show_EEF:
    EEF = frame_to_rhino(robot.from_BCF_to_WCF(robot.forward_kinematics(
        configuration, options=dict(solver="model")
        )))

if show_visual_meshes == True:
    visual_meshes = robot.draw_visual()
    # orient the robot to its base plane:
    robot_BCF = frame_to_rhino_plane(robot.BCF) 
    print(type(robot_BCF))
    init_robot_plane = rg.Plane.WorldXY
    #visual_meshes = ghcomp.Orient(visual_meshes, init_robot_plane, robot_BCF)[0]

if show_robot_collision_meshes == True:
    robot_collision_meshes = robot.draw_collision()

cached_scene_key = "cached_scene"

if show_collision_meshes or show_attached_collision_meshes:
    cached_scene = st.get(cached_scene_key)
    if not cached_scene:
        cached_scene = {"time": 0}

    # # expire cache if the component has not been executed in the last 2 seconds
    # # this allows to slide through a list of configurations
    # # without triggering refreshes of the scene in the middle of it

    # if time.time() - cached_scene["time"] > 2:
    #     update_scene = True
    # else:
    #     update_scene = False

    update_scene = True

    if update_scene:
        scene = PlanningScene(robot)
        scene = robot.client.get_planning_scene()

    if update_scene and show_collision_meshes:
        collision_meshes = []

        for co in scene.world.collision_objects:
            print(co)
            header = co.header
            frame_id = header.frame_id
            cms = co.to_collision_meshes()

            for cm in cms:
                if cm.frame != Frame.worldXY():
                    t = Transformation.from_frame(cm.frame)
                    mesh = cm.mesh.transformed(t)
                else:
                    mesh = cm.mesh
                collision_meshes.extend(SceneObject(item=mesh).draw())

        cached_scene["cm"] = collision_meshes

        collision_meshes = cached_scene.get("cm", [])

    if update_scene and show_attached_collision_meshes:
        attached_meshes = []

        for aco in scene.robot_state.attached_collision_objects:
            for acm in aco.to_attached_collision_meshes():
                frame_id = aco.object["header"]["frame_id"]
                frame = robot.forward_kinematics(configuration, options=dict(link=frame_id))
                t = Transformation.from_frame(frame)

                # Local CM frame
                if acm.collision_mesh.frame and acm.collision_mesh.frame != Frame.worldXY():
                    t = t * Transformation.from_frame(acm.collision_mesh.frame)

                mesh = acm.collision_mesh.mesh.transformed(t)

                attached_meshes.extend(SceneObject(item=mesh).draw())

        cached_scene["acm"] = attached_meshes

        attached_meshes = cached_scene.get("acm", [])
    
    cached_scene["time"] = time.time()
    st[cached_scene_key] = cached_scene
# ---------- end visualise ----------
py3_2 = Python3Script(planes=[visualise.BCF, visualise.RCF, visualise.EEF], scale=Slider(0.2, range=0..1))  # -> P, V, C, W; inputs planes: list of Plane, scale: Double
# ---------- py3_2: Python ----------
from Rhino.Display import ColorRGBA
from ghpythonlib.components import ColourRGBf


red = ColourRGBf(255, 255, 0, 0)
green = ColourRGBf(255, 0, 255, 0)
blue = ColourRGBf(255, 0, 0, 255)

P = []
V = []
C = []

# scale = float(scale)

for plane in planes:
    if not plane:
        continue
    P += [plane.Origin] * 3
    V.append(plane.XAxis * scale)
    V.append(plane.YAxis * scale)
    V.append(plane.ZAxis * scale)
    C += [red, green, blue]

W = 3
# ---------- end py3_2 ----------
pln_8 = Plane(visualise.joint_planes)
mesh_2 = Mesh(visualise.visual_meshes)
mesh_3 = Mesh(visualise.collision_meshes)
orient_5 = Orient(Geometry=visualise.visual_meshes, Source=PlaneXY(0, 0, 0), Target=visualise.BCF)  # -> Geometry, Transform
vdisex = VectorDisplayEx(Point=py3_2.P, Vector=py3_2.V, Colour=py3_2.C, Width=py3_2.W)
preview_5 = CustomPreview(Geometry=orient_5.Geometry, Material=ColourSwatch(SwatchColor=RGB(74, 74, 74)))

# ----
# Move to place
number_slider_7 = Slider(0.098, range=0..0.5)
# Move to pick
number_slider_8 = Slider(0.01, range=0..0.01)
movej = Python3Script(configurations=entwine_3, velocity=number_slider_7, radius=number_slider_8)  # -> urscript, lift, values; inputs configurations: list
# ---------- movej: Python ----------
from ur_fabrication_control.direct_control import URScript
from compas_robots import Configuration
import math

add_360 = False
if configurations[0].revolute_values[0] <0:
    add_360 = True
urscript = URScript()
urscript.start()
for configuration in configurations:
    rev_values = configuration.revolute_values
    if len(rev_values)>6:
        rev_values = list(rev_values[2:8])
    
    rev_values[0] -= math.pi/2
    if add_360:
        rev_values[0] += 2*math.pi

    joint_configuration = Configuration.from_revolute_values(rev_values)
    # print(joint_configuration)

    lift = configuration
    urscript.move_joint(joint_configuration, velocity, radius)
urscript.end()

urscript = urscript.generate()

print(urscript)
# ---------- end movej ----------
send = Button()
ur_send = Python3Script(urscript=movej.urscript, send=send)  # -> out; inputs urscript: String
# ---------- ur_send: Python ----------
from scriptcontext import sticky as st
from ur_fabrication_control.direct_control import send_script

ur_ip = st["ur_ip"]
ur_port = st["ur_port"]

print(urscript)

if send:
    send_script(urscript, ur_ip, ur_port)
# ---------- end ur_send ----------

movej_2 = Python3Script(configurations=entwine_4, velocity=Slider(0.098, range=0..0.5), radius=Slider(0.01, range=0..0.01))  # -> urscript, lift, values; inputs configurations: list; same code as movej
send_2 = Button()
ur_send_2 = Python3Script(urscript=movej_2.urscript, send=send_2)  # -> out; inputs urscript: String; same code as ur_send

pln_9 = Plane(Plane(origin=(1.630467741, 0.2394988522, 1.123755367), x=(-0.4120286439, -0.7623659212, -0.4990296572), y=(-0.6723263342, 0.6240251434, -0.3982083885)))

# ----
# Stop
stop_2 = Button()
stop_3 = Python3Script(stop=stop_2)
# ---------- stop_3: Python ----------
from scriptcontext import sticky as st
from ur_fabrication_control.direct_control.common import send_stop

ur_ip = st["ur_ip"]
ur_port = st["ur_port"]

if stop:
    send_stop(ur_ip, ur_port)
# ---------- end stop_3 ----------

# ----
# Move Cartesian
list_9 = ValueList({"send one cartesian position": 0, "send all cartesian positions": 1}, selected="send one cartesian position")
filter_2 = StreamFilter(Gate=list_9, Stream1=pln_9)
radius = Slider(0.003, range=0..0.5)
movel = Python3Script(robot=robot, planes_WCS=filter_2, velocity=Slider(0.05, range=0..0.5), radius=radius)  # -> urscript; inputs planes_WCS: list of Plane
# ---------- movel: Python ----------
import Rhino.Geometry as rg
from compas.geometry import Frame
from compas.geometry import Transformation, Rotation
from compas_rhino.conversions import plane_to_compas_frame
from compas_ghpython.drawing import draw_frame
from ur_fabrication_control import direct_control 
import math

from scriptcontext import sticky as st
from ur_fabrication_control.direct_control import URScript

# retrieve the current tool frame in axis angle format
if robot.attached_tool:
    tool_angle_axis = list(robot.attached_tool.frame.point) + list(robot.attached_tool.frame.axis_angle_vector)
else:
    tool0_frame = Frame([0, 0, 0], [1, 0, 0], [0, 1, 0])
    tool_angle_axis = list(tool0_frame.point) + list(tool0_frame.axis_angle_vector)

frames_RCS = []
for plane_WCS in planes_WCS:
    frame_WCS = plane_to_compas_frame(plane_WCS)
    frame_RCS = robot.from_WCF_to_RCF(frame_WCS)
    pose = frame_RCS.point.__data__ + frame_RCS.axis_angle_vector.__data__
    x = "p[{}, {}, {}, {}, {}, {}]".format(*pose)
    print(x)
    frames_RCS.append(frame_RCS)

urscript = URScript()
urscript.start()
urscript.set_tcp(tool_angle_axis)
for frame_RCS in frames_RCS:
    urscript.move_linear(frame=frame_RCS, velocity=velocity, radius=radius)
urscript.end()

urscript = urscript.generate()

print(urscript)
# ---------- end movel ----------
send_3 = Button()
ur_send_3 = Python3Script(urscript=movel, send=send_3)  # -> out; inputs urscript: String
# ---------- ur_send_3: Python ----------
from scriptcontext import sticky as st
from ur_fabrication_control.direct_control import send_script

ur_ip = st["ur_ip"]
ur_port = st["ur_port"]

if send:
    send_script(urscript, ur_ip, ur_port)
# ---------- end ur_send_3 ----------

# ----
# Direct UR control
# Move Joints
list_10 = ValueList({"send forward configuration": 0, "send ik configuration": 1, "send one motion configuration": 2, "send all motion configurations": 3}, selected="send all motion configurations")
filter_3 = StreamFilter(Gate=list_10, Stream1=analytic_inverse_3.configuration, Stream2=inverse.configuration, Stream3=flatten)
movej_3 = Python3Script(configurations=filter_3, velocity=Slider(0.098, range=0..0.5), radius=Slider(0.01, range=0..0.01))  # -> urscript, lift, values; inputs configurations: list; same code as movej
send_4 = Button()
ur_send_4 = Python3Script(urscript=movej_3.urscript, send=send_4)  # -> out; inputs urscript: String; same code as ur_send

mesh_4 = Mesh(visualise.robot_collision_meshes)
mesh_5 = Mesh(visualise.attached_meshes)

# ----
# IP Settings
# --> Set your IP address
# --> Set robot IP address
ur_ip = ValueList({"192.168.0.118", "127.0.0.1"}, selected="192.168.0.118")
ur_port = ValueList({"30002"}, selected="30002")
globals = Python3Script(ur_ip=ur_ip, ur_port=ur_port, clear=Button())  # inputs ur_ip: String, ur_port: Int32
# ---------- globals: Python ----------
from scriptcontext import sticky as st

st["ur_ip"] = ur_ip
st["ur_port"] = ur_port

if clear:
    st.clear()
# ---------- end globals ----------

# ----
# Check if UR robot
#  is available
ping = Button()
ping_2 = Python3Script(ip=ur_ip, ping=ping)  # -> out; inputs ip: String
# ---------- ping_2: Python ----------
from scriptcontext import sticky as st
from ur_fabrication_control.direct_control.utilities import is_available

guid = str(ghenv.Component.InstanceGuid)
txt_key = "txt_" + guid
if txt_key not in st:
    st[txt_key] = ""

if ping:
    
    available = is_available(ip)
    
    if available:
        st[txt_key] = "%s is up!" % ip
        trigger = True
    else:
        st[txt_key] = "%s is down!" % ip
        trigger = False

print(st[txt_key])
# ---------- end ping_2 ----------
panel_6 = Panel(ping_2)
